# Grasshopper definition 140512_Invisible cities_script01.gh (Grasshopper 0.9.75)
# plug-ins: SonicTweet, SonicStringSearch

panel = Panel("\"kwanphilcho\"")
twitter = SonicTweet(Search="\"UrbanDrift00\"", nResults="100")  # -> Message, fromUser, toUser, Date, Location, hasGeo, ProfilePic, Followers, ID
pdecon = Deconstruct(Point=twitter.Location)  # -> XComponent, YComponent, ZComponent

panel_2 = Panel("seach text component")
message = Panel(twitter.Message)
findstring = SonicStringSearch(SearchPhrase="Traffic_", TestToSearch=message, CaseSensitive=Toggle(True))
panel_3 = Panel(findstring)
dispatch = Dispatch(List=message, DispatchPattern=findstring)  # -> ListA, ListB
panel_4 = Panel(dispatch.ListB)
panel_5 = Panel(dispatch.ListA)

pt = ConstructPoint(XCoordinate=pdecon.YComponent, YCoordinate=pdecon.XComponent, ZCoordinate=0)
pt_2 = Point(pt)
flatten = FlattenTree(Tree=pt_2, Path="{0}")

panel_6 = Panel("Drift Frequency")
prox = Proximity2D(Points=flatten, Plane=PlaneXY(0, 0, 0), Group=Slider(5, range=0..10))  # -> Links, Topology
flatten_2 = FlattenTree(Tree=prox.Links, Path="{0}")
len = Length(Curve=flatten_2)
bnd = Bounds(Numbers=len)
dedomain = DeconstructDomain(Domain=bnd)  # -> Start, End
gradient = Gradient(LowerLimit=dedomain.Start, UpperLimit=dedomain.End, Parameter=len, stops=[0: RGB(217, 202, 205), 1: RGB(191, 19, 19)])
preview = CustomPreview(Geometry=flatten_2, Shader=gradient)

panel_7 = Panel("Total Drift Route")
pline = PolyLine(Vertices=flatten, Closed=False)

split = TextSplit(Text=panel_5, Separators="_")
panel_8 = Panel(split)
dispatch_2 = Dispatch(List=flatten, DispatchPattern=findstring)  # -> ListA, ListB
flatten_3 = FlattenTree(Tree=dispatch_2.ListA, Path="{0}")

panel_9 = Panel("Values Extraction")
item = ListItem(List=split, Index=0, Wrap=True)  # -> Item, flatten(Item1), flatten(Item2)

pt_3 = Point(flatten_3)
item_2 = ListItem(List=pt_3, Index=Slider(5, range=0..10), Wrap=True)
date = Panel(item.Item2)

panel_10 = Panel("Specific Drift Route")
pline_2 = PolyLine(Vertices=pt_3, Closed=False)

panel_11 = Panel("Circle Intensity Mapping")
bnd_2 = Bounds(Numbers=flatten(item.Item2))
dom = ConstructDomain(DomainStart=Slider(0.00018, range=0..0.01), DomainEnd=Slider(0.00041, range=0..0.01))
remap = RemapNumbers(Value=item.Item2, Source=bnd_2, Target=dom)  # -> Mapped, Clipped
cir = Circle(Plane=pt_3, Radius=remap.Mapped)
