# Grasshopper definition 140512_Invisible cities_script02.gh (Grasshopper 0.9.75)
# plug-ins: Kangaroo Components, SonicTweet, SonicStringSearch

panel = Panel("\"kwanphilcho\"")
panel_2 = Panel("\"Ing0h\"")
panel_3 = Panel("\"ReishinWatabe\"")
panel_4 = Panel("\"Mudzali\"")
panel_5 = Panel("\"UrbanDrift00\"")
panel_6 = Panel("\"mhbae93\"")
panel_7 = Panel("\"jibae365\"")
twitter = SonicTweet(Search="\"FusterPablo\"", nResults="37")  # -> Message, fromUser, toUser, Date, Location, hasGeo, ProfilePic, Followers, ID
panel_8 = Panel(twitter.Message)
pdecon = Deconstruct(Point=twitter.Location)  # -> XComponent, YComponent, ZComponent
null = NullItem(Item=pdecon.XComponent)  # -> NullFlags, InvalidFlags, Description
dispatch = Dispatch(List=twitter.Message, DispatchPattern=null.NullFlags)  # -> ListA, ListB
dispatch_2 = Dispatch(List=twitter.Location, DispatchPattern=null.NullFlags)  # -> ListA, ListB

message = Panel(dispatch.ListB)
panel_9 = Panel("seach text component")
findstring = SonicStringSearch(SearchPhrase="ARTS_", TestToSearch=message, CaseSensitive=Toggle(True))
panel_10 = Panel(findstring)
dispatch_3 = Dispatch(List=message, DispatchPattern=findstring)  # -> ListA, ListB
panel_11 = Panel(dispatch_3.ListA)
panel_12 = Panel(dispatch_3.ListB)

pdecon_2 = Deconstruct(Point=dispatch_2.ListB)  # -> XComponent, YComponent, ZComponent
panel_13 = Panel("18")
pt = ConstructPoint(XCoordinate=pdecon_2.YComponent, YCoordinate=pdecon_2.XComponent, ZCoordinate=0)
item = ListItem(List=pt, Index="31", Wrap=True)
item_2 = ListItem(List=pt, Index=Slider(1, range=0..38), Wrap=True)
panel_14 = Panel(pt)
pt_2 = Point(pt)
flatten = FlattenTree(Tree=pt_2, Path="{0}")

panel_15 = Panel("Drift Frequency")
prox = Proximity2D(Points=flatten, Plane=PlaneXY(0, 0, 0), Group=Slider(5, range=0..10))  # -> Links, Topology
flatten_2 = FlattenTree(Tree=prox.Links, Path="{0}")
len = Length(Curve=flatten_2)
bnd = Bounds(Numbers=len)
dedomain = DeconstructDomain(Domain=bnd)  # -> Start, End
gradient = Gradient(LowerLimit=dedomain.Start, UpperLimit=dedomain.End, Parameter=len, stops=[0: RGB(217, 202, 205), 1: RGB(191, 19, 19)])
preview = CustomPreview(Geometry=flatten_2, Shader=gradient)

duppt = RemoveDuplicatePts(Points=flatten, Tolerance=0.01)

panel_16 = Panel("Total Drift Route")
pline = PolyLine(Vertices=flatten, Closed=False)

flip = FlipCurve(Curve=pline)  # -> Curve, Flag
split = TextSplit(Text=panel_11, Separators="_")
eval = EvaluateCurve(Curve=reparameterize(flip.Curve), Parameter=Slider(0.103, range=0..1))  # -> Point, Tangent, Angle
panel_17 = Panel(split)
dispatch_4 = Dispatch(List=flatten, DispatchPattern=findstring)  # -> ListA, ListB
flatten_3 = FlattenTree(Tree=dispatch_4.ListA, Path="{0}")
pt_3 = Point(flatten_3)

panel_18 = Panel("Values Extraction")
item_3 = ListItem(List=split, Index=0, Wrap=True)  # -> Item, flatten(Item1), flatten(Item2), flatten(Item3)

item_4 = ListItem(List=pt_3, Index=Slider(5, range=0..10), Wrap=True)
date = Panel(item_3.Item3)

panel_19 = Panel("Specific Drift Route")
pline_2 = PolyLine(Vertices=pt_3, Closed=False)

chars = Characters(Text=date)  # -> Result, Unicode
panel_20 = Panel(chars.Result)
subset = SubList(List=panel_20, Domain="0", Wrap=True)  # -> flatten(List), Index
panel_21 = Panel(subset.List)

panel_22 = Panel("Circle Intensity Mapping")
bnd_2 = Bounds(Numbers=flatten(panel_21))
dom = ConstructDomain(DomainStart=Slider(0.00071, range=0..0.01), DomainEnd=Slider(0.00281, range=0..0.01))
remap = RemapNumbers(Value=panel_21, Source=bnd_2, Target=dom)  # -> Mapped, Clipped
cir = Circle(Plane=pt_3, Radius=remap.Mapped)
