# Grasshopper definition 140519_Vertical studio_Subjective_3D mapping pablo.gh (Grasshopper 0.9.75)
# plug-ins: SonicTweet, SonicStringSearch

# ---- group: Group 2
# username to look for
panel = Panel("urbandriftpab1")
panel_2 = Panel("urbandriftmyo1")

# ----
# estract specific tweet:
# here you can check the message of the tweet
# you are extracting and you can use the
#  location to plot into a map
twitter = SonicTweet(Search=panel, nResults="37")  # -> Message, fromUser, toUser, Date, Location, hasGeo, ProfilePic, Followers, ID
panel_3 = Panel(twitter.Message)
merge = Merge(Data1=Slider(27, range=0..30), Data2=Slider(15, range=0..30), Data3=Slider(7, range=0..30))
item = ListItem(List=twitter.Message, Index=merge, Wrap=True)
item_2 = ListItem(List=twitter.Location, Index=merge, Wrap=True)
pdecon = Deconstruct(Point=item_2)  # -> XComponent, YComponent, ZComponent
panel_4 = Panel(item)

# ----
# Points
pt = ConstructPoint(XCoordinate=pdecon.YComponent, YCoordinate=pdecon.XComponent, ZCoordinate=0)

split = TextSplit(Text=item_2, Separators=",")
item_3 = ListItem(List=split, Index=0, Wrap=True)  # -> Item, Item1

# ----
# word to look for
panel_5 = Panel("art OR gallery OR creative OR painting OR streetart OR artistic OR graffiti OR colorful OR exhibition")

# ----
# radius in Km
number_slider = Slider(3, range=0..5)

twitter_2 = SonicTweet(Search=panel_5, GeoLat=item_3.Item, GeoLon=item_3.Item1, GeoRadius=number_slider, nResults="100")  # -> Message, fromUser, toUser, Date, Location, hasGeo, ProfilePic, Followers, ID
number_slider_2 = Slider(100, range=0..100)
pdecon_2 = Deconstruct(Point=twitter_2.Location)  # -> XComponent, YComponent, ZComponent
panel_6 = Panel(twitter_2.Message)

# ----
# slider for number of lines
number_slider_3 = Slider(0.015, range=0..0.015)

# ----
# point on map
pt_2 = ConstructPoint(XCoordinate=pdecon_2.YComponent, YCoordinate=pdecon_2.XComponent, ZCoordinate=0)  # -> flatten(Point)

clean = CleanTree(Tree=pt_2, CleanInvalid=True, CleanEmpty=True)
prox = Proximity3D(Points=clean, Group=5, MaxRadius=number_slider_3)  # -> flatten(Links), Topology
len = Length(Curve=prox.Links)
dom = ConstructDomain(DomainStart=Slider(0, range=0..100), DomainEnd=Slider(7, range=0..10))
bnd = Bounds(Numbers=len)
remap = RemapNumbers(Value=len, Source=bnd, Target=dom)  # -> Mapped, Clipped
crv = Curve(prox.Links)

# ----
# layernames
panel_7 = Panel("network line_")

int = Integer(remap.Mapped)
# to bake the lines
toggle = BooleanToggle(False)

# ---- group: Group 3
panel_8 = Panel("urbandriftpab1")

# ----
concat = Concatenate(FragmentA=panel_7, FragmentB=int)
panel_10 = Panel(concat)
twitter_3 = SonicTweet(Search="urbandriftpab1", nResults=number_slider_2)  # -> Message, fromUser, toUser, Date, Location, hasGeo, ProfilePic, Followers, ID
bakeattributes2 = BakeAttributes(obj=crv, layer=concat, activate=toggle)  # -> out; inputs obj: GeometryBase, name: String, layer: String, color: Color, pWidth: Double, wires: Int32, activate: Boolean
# ---------- bakeattributes2: C# ----------
    //Inserts geometry into the Rhino document, with custom attributes
    //Written by Giulio Piacentino
    //Version written 2010 11 21 - for Grasshopper 0.8.002

    if (activate)
    {
      if(obj == null)
      {
        Print("No object to bake");
        return;
      }

      //Make new attribute to set name
      Rhino.DocObjects.ObjectAttributes att = new Rhino.DocObjects.ObjectAttributes();

      //Set object name
      if(!string.IsNullOrEmpty(name))
      {
        att.Name = name;
      }

      //Set color
      if(!color.IsEmpty)
      {
        att.ColorSource = Rhino.DocObjects.ObjectColorSource.ColorFromObject; //Make the color type "by object"
        att.ObjectColor = color;

        att.PlotColorSource = Rhino.DocObjects.ObjectPlotColorSource.PlotColorFromObject; //Make the plot color type "by object"
        att.PlotColor = color;
      }

      //Set layer
      if(!string.IsNullOrEmpty(layer) && Rhino.DocObjects.Layer.IsValidName(layer))
      {
        //Get the current layer index
        Rhino.DocObjects.Tables.LayerTable layerTable = doc.Layers;
        //int layerIndex = layerTable.Find(layer, true);
        int layerIndex = layerTable.FindByFullPath(layer, true);

        if(layerIndex < 0) //This layer does not exist, we add it
        {
          Rhino.DocObjects.Layer onlayer = new Rhino.DocObjects.Layer(); //Make a new layer
          onlayer.Name = layer;

          layerIndex = layerTable.Add(onlayer); //Add the layer to the layer table
          if (layerIndex > -1) //We manged to add layer!
          {
            att.LayerIndex = layerIndex;
            Print("Added new layer to the document at position " + layerIndex + " named " + layer + ". ");
          } else
            Print("Layer did not add. Try cleaning up your layers."); //This never happened to me.
        }
        else
          att.LayerIndex = layerIndex; //We simply add to the existing layer
      }


      //Set plotweight
      if(pWidth > 0)
      {
        att.PlotWeightSource = Rhino.DocObjects.ObjectPlotWeightSource.PlotWeightFromObject;
        att.PlotWeight = pWidth;
      }


      //Set material
      bool materialByName = !string.IsNullOrEmpty(material as string);
      Rhino.Display.DisplayMaterial inMaterial = material as Rhino.Display.DisplayMaterial;
      if(material is Color)
      {
        inMaterial = new Rhino.Display.DisplayMaterial((Color) material);
      }
      if(material != null && inMaterial == null && !materialByName)
      {
        if(!(material is string))
        {
          try //We also resort to try with IConvertible
          {
            inMaterial = (Rhino.Display.DisplayMaterial) Convert.ChangeType(material, typeof(Rhino.Display.DisplayMaterial));
          }
          catch(InvalidCastException)
          {
          }
        }
      }
      if(inMaterial != null || materialByName)
      {
        string matName;

        if(!materialByName)
        {
          matName = string.Format("A:{0}-D:{1}-E:{2}-S:{3},{4}-T:{5}",
            Format(inMaterial.Ambient),
            Format(inMaterial.Diffuse),
            Format(inMaterial.Emission),
            Format(inMaterial.Specular),
            inMaterial.Shine.ToString(),
            inMaterial.Transparency.ToString()
            );
        }
        else
        {
          matName = (string) material;
        }

        int materialIndex = doc.Materials.Find(matName, true);
        if(materialIndex < 0 && !materialByName) //Material does not exist and we have its specs
        {
          materialIndex = doc.Materials.Add(); //Let's add it
          if(materialIndex > -1)
          {
            Print("Added new material at position " + materialIndex + " named \"" + matName + "\". ");
            Rhino.DocObjects.Material m = doc.Materials[materialIndex];
            m.Name = matName;
            m.AmbientColor = inMaterial.Ambient;
            m.DiffuseColor = inMaterial.Diffuse;
            m.EmissionColor = inMaterial.Emission;
            //m.ReflectionColor = no equivalent
            m.SpecularColor = inMaterial.Specular;
            m.Shine = inMaterial.Shine;
            m.Transparency = inMaterial.Transparency;
            //m.TransparentColor = no equivalent
            m.CommitChanges();

            att.MaterialSource = Rhino.DocObjects.ObjectMaterialSource.MaterialFromObject;
            att.MaterialIndex = materialIndex;
          }
          else
            Print("Material did not add. Try cleaning up your materials."); //This never happened to me.
        }
        else if(materialIndex < 0 && materialByName) //Material does not exist and we do not have its specs. We do nothing
        {
          Print("Warning: material name not found. I cannot set the source to this material name. Add a material with name: " + matName);
        }
        else
        {
          //If this material exists, we do not replace it!
          att.MaterialSource = Rhino.DocObjects.ObjectMaterialSource.MaterialFromObject;
          att.MaterialIndex = materialIndex;
        }
      }


      //Set wire density
      if(wires == -1 || wires > 0)
      {
        att.WireDensity = wires;
      }


      //Bake to the right type of object
      switch(obj.ObjectType)
      {
        case Rhino.DocObjects.ObjectType.Brep:
          doc.Objects.AddBrep(obj as Brep, att);
          break;
        case Rhino.DocObjects.ObjectType.Curve:
          doc.Objects.AddCurve(obj as Curve, att);
          break;
        case Rhino.DocObjects.ObjectType.Point:
          doc.Objects.AddPoint((obj as Rhino.Geometry.Point).Location, att);
          break;
        case Rhino.DocObjects.ObjectType.Surface:
          doc.Objects.AddSurface(obj as Surface, att);
          break;
        case Rhino.DocObjects.ObjectType.Mesh:
          doc.Objects.AddMesh(obj as Mesh, att);
          break;
        case Rhino.DocObjects.ObjectType.Extrusion:
          typeof(Rhino.DocObjects.Tables.ObjectTable).InvokeMember("AddExtrusion", BindingFlags.Instance | BindingFlags.InvokeMethod, null, doc.Objects, new object[]{obj, att});
          break;
        case Rhino.DocObjects.ObjectType.PointSet:
          doc.Objects.AddPointCloud(obj as Rhino.Geometry.PointCloud, att); //This is a speculative entry
          break;
        default:
          Print("The script does not know how to handle this type of geometry: " + obj.GetType().FullName);
          break;
      }
      Print("Added " + obj.GetType().Name);

    }
    else
    {
      Print("Inactive");
    }
# ---------- bakeattributes2: C# additional code ----------
  static string Format(Color c)
  {
    return (new System.Text.StringBuilder("A")).Append(c.A.ToString()).Append("R").Append(c.R.ToString()).Append("G")
      .Append(c.G.ToString()).Append("B").Append(c.B.ToString()).ToString();
  }
# ---------- end bakeattributes2 ----------
twitter_4 = SonicTweet(Search=panel_8, nResults=number_slider_2)  # -> Message, fromUser, toUser, Date, Location, hasGeo, ProfilePic, Followers, ID
panel_11 = Panel(twitter_4.Message)
panel_12 = Panel(bakeattributes2)
panel_13 = Panel(twitter_3.Message)

cull = CullPattern(List=twitter_4.Location, CullPattern=twitter_4.hasGeo)
cull_2 = CullPattern(List=twitter_4.Message, CullPattern=twitter_4.hasGeo)
pdecon_3 = Deconstruct(Point=cull)  # -> XComponent, YComponent, ZComponent
findstring = SonicStringSearch(SearchPhrase="ADVS", TestToSearch=cull_2)
pt_3 = ConstructPoint(XCoordinate=pdecon_3.YComponent, YCoordinate=pdecon_3.XComponent, ZCoordinate=0)
dispatch = Dispatch(List=cull_2, DispatchPattern=findstring)  # -> ListA, ListB
dispatch_2 = Dispatch(List=pt_3, DispatchPattern=findstring)  # -> ListA, ListB
split_2 = TextSplit(Text=dispatch.ListA, Separators=",")
item_4 = ListItem(List=split_2, Index=0, Wrap=True)  # -> Item, Item1
split_3 = TextSplit(Text=item_4.Item1, Separators="_")

cull_3 = CullPattern(List=twitter_3.Message, CullPattern=twitter_3.hasGeo)
cull_4 = CullPattern(List=twitter_3.Location, CullPattern=twitter_3.hasGeo)
pdecon_4 = Deconstruct(Point=cull_4)  # -> XComponent, YComponent, ZComponent
findstring_2 = SonicStringSearch(SearchPhrase="ARTS", TestToSearch=cull_3)
pt_4 = ConstructPoint(XCoordinate=pdecon_4.YComponent, YCoordinate=pdecon_4.XComponent, ZCoordinate=0)
dispatch_3 = Dispatch(List=cull_3, DispatchPattern=findstring_2)  # -> ListA, ListB
dispatch_4 = Dispatch(List=pt_4, DispatchPattern=findstring_2)  # -> ListA, ListB
split_4 = TextSplit(Text=dispatch_3.ListA, Separators=",")
item_5 = ListItem(List=split_4, Index=0, Wrap=True)  # -> Item, Item1
split_5 = TextSplit(Text=item_5.Item, Separators="_")

# ---- group: SOB Value
item_6 = ListItem(List=split_3, Index=0, Wrap=True)  # -> Item, Item1, Item2, flatten(Item3)

# ---- group: SiOB Value
item_7 = ListItem(List=split_5, Index=0, Wrap=True)  # -> Item, Item1, Item2, flatten(Item3)

# ----
# this cleans the value if an "http" is linked to it
panel_14 = Panel("")
split_6 = TextSplit(Text=item_7.Item3, Separators=panel_14)
item_8 = ListItem(List=split_6, Index=0, Wrap=True)  # -> flatten(Item)

# ---- group: SOB location
pt_5 = Point(dispatch_2.ListA)

# ---- group: SiOB location
pt_6 = Point(dispatch_4.ListA)

# ----
panel_15 = Panel(item_6.Item3)
tag = TextTag(Location=pt_6, Text=item_7.Item3)
panel_16 = Panel(item_8)

pline = PolyLine(Vertices=pt_3, Closed=False)
panel_17 = Panel("Drift Tracking")

panel_18 = Panel("Specific Drift routes")
pline_2 = PolyLine(Vertices=pt_6, Closed=False)

panel_19 = Panel("Drift Frequency")
prox_2 = Proximity2D(Points=pt_3, Plane=PlaneXY(0, 0, 0), Group=Slider(8, range=0..10))  # -> Links, Topology
flatten = FlattenTree(Tree=prox_2.Links, Path="{0}")
len_2 = Length(Curve=flatten)
bnd_2 = Bounds(Numbers=len_2)
dedomain = DeconstructDomain(Domain=bnd_2)  # -> Start, End
gradient = Gradient(LowerLimit=dedomain.Start, UpperLimit=dedomain.End, Parameter=len_2, stops=[0: RGB(217, 202, 205), 1: RGB(191, 19, 19)])
preview = CustomPreview(Geometry=flatten, Shader=gradient)

pline_3 = PolyLine(Vertices=pt_5, Closed=False)

number_slider_4 = Slider(0.95, range=0..1)
eval = EvaluateCurve(Curve=reparameterize(pline), Parameter=number_slider_4)  # -> Point, Tangent, Angle

# ----
# if it' RED it means that there ae some tweets
# which are wrong (they are missing a comma...)
# please delete them from your twitter account
panel_21 = Panel("Circle Intensity Mapping")
bnd_3 = Bounds(Numbers=flatten(item_6.Item3))
dom_2 = ConstructDomain(DomainStart=Slider(0.0008, range=0..0.01), DomainEnd=Slider(0.0025, range=0..0.01))
remap_2 = RemapNumbers(Value=panel_15, Source=bnd_3, Target=dom_2)  # -> Mapped, Clipped
cir = Circle(Plane=pt_5, Radius=remap_2.Mapped)

len_3 = Length(Curve=pline_3)

# ---- group: Starting point
lng = ListLength(List=pt_3)
item_9 = ListItem(List=pt_3, Index=lng, Wrap=True)

# ----
multiplication = Multiplication(A=len_3, B=Slider(100000, range=0..100000))
panel_22 = Panel(len_3)
panel_23 = Panel(remap_2.Mapped)

# ---- group: End point
item_10 = ListItem(List=pt_3, Index=0, Wrap=True)

# ---- group: Generating lines
eval_2 = EvaluateLength(Curve=pline, Length=number_slider_4, Normalized=True)  # -> Point, Tangent, Parameter
shatter = Shatter(Curve=pline, Parameters=eval_2.Parameter)
item_11 = ListItem(List=shatter, Index=0, Wrap=True)
crv_2 = Curve(item_11)

# ----
# if it' RED it means that there ae some tweets
# which are wrong (they are missing a comma...)
# please delete them from your twitter account
panel_24 = Panel("Circle Intensity Mapping")
bnd_4 = Bounds(Numbers=flatten(panel_16))
dom_3 = ConstructDomain(DomainStart=Slider(0.0008, range=0..0.01), DomainEnd=Slider(0.0025, range=0..0.01))
remap_3 = RemapNumbers(Value=panel_16, Source=bnd_4, Target=dom_3)  # -> Mapped, Clipped
cir_2 = Circle(Plane=pt_6, Radius=remap_3.Mapped)

flip = FlipCurve(Curve=pline_2)  # -> Curve, Flag

eval_3 = EvaluateLength(Curve=flip.Curve, Length=Slider(0, range=0..1), Normalized=True)  # -> Point, Tangent, Parameter
shatter_2 = Shatter(Curve=flip.Curve, Parameters=eval_3.Parameter)
item_12 = ListItem(List=shatter_2, Index=0, Wrap=True)
crv_3 = Curve(item_12)

# ----
# Arts
crv_4 = Curve([<curve referenced from the Rhino model> x34])
# 2nd Drift Pablo
number_slider_5 = Slider(0.0025, range=0..0.01)
darc = DeconstructArc(Arc=crv_4)  # -> BasePlane, Radius, Angle
bnd_5 = Bounds(Numbers=darc.Radius)
dom_4 = ConstructDomain(DomainStart=Slider(0.0008, range=0..0.01), DomainEnd=number_slider_5)
pt_7 = Point(darc.BasePlane)
remap_4 = RemapNumbers(Value=darc.Radius, Source=bnd_5, Target=dom_4)  # -> Mapped, Clipped
cir_3 = Circle(Plane=pt_7, Radius=remap_4.Mapped)

# ----
# ADs
crv_5 = Curve([<curve referenced from the Rhino model> x17])
darc_2 = DeconstructArc(Arc=crv_5)  # -> BasePlane, Radius, Angle
bnd_6 = Bounds(Numbers=darc_2.Radius)
dom_5 = ConstructDomain(DomainStart=Slider(0.0008, range=0..0.01), DomainEnd=Slider(0.0025, range=0..0.01))
pt_8 = Point(darc_2.BasePlane)
remap_5 = RemapNumbers(Value=darc_2.Radius, Source=bnd_6, Target=dom_5)  # -> Mapped, Clipped
cir_4 = Circle(Plane=pt_8, Radius=remap_5.Mapped)

bnd_7 = Bounds(Numbers=remap_5.Mapped)
bnd_8 = Bounds(Numbers=remap_4.Mapped)
panel_25 = Panel(remap_4.Mapped)
dom_6 = ConstructDomain(DomainStart=Slider(1, range=0..4), DomainEnd=Slider(4, range=0..4))
dom_7 = ConstructDomain(DomainStart=Slider(1, range=0..4), DomainEnd=Slider(4, range=0..4))
remap_6 = RemapNumbers(Value=remap_5.Mapped, Source=bnd_7, Target=dom_6)  # -> flatten(Mapped), Clipped
remap_7 = RemapNumbers(Value=remap_4.Mapped, Source=bnd_8, Target=dom_7)  # -> Mapped, Clipped
panel_26 = Panel(remap_7.Mapped)
panel_27 = Panel(remap_6.Mapped)
int_2 = Integer(panel_26)
int_3 = Integer(flatten(panel_27))
panel_28 = Panel(int_3)
panel_29 = Panel(int_2)

# ----
# 2nd Drift Myoung
panel_30 = Panel("urbandriftmyo1")
twitter_5 = SonicTweet(Search=panel_30, nResults=number_slider_2)  # -> Message, fromUser, toUser, Date, Location, hasGeo, ProfilePic, Followers, ID
twitter_6 = SonicTweet(Search="urbandriftmyo1", nResults=number_slider_2)  # -> Message, fromUser, toUser, Date, Location, hasGeo, ProfilePic, Followers, ID

cull_5 = CullPattern(List=twitter_5.Location, CullPattern=twitter_5.hasGeo)
cull_6 = CullPattern(List=twitter_5.Message, CullPattern=twitter_5.hasGeo)
pdecon_5 = Deconstruct(Point=cull_5)  # -> XComponent, YComponent, ZComponent
findstring_3 = SonicStringSearch(SearchPhrase="ARTS", TestToSearch=cull_6)
pt_9 = ConstructPoint(XCoordinate=pdecon_5.YComponent, YCoordinate=pdecon_5.XComponent, ZCoordinate=0)
dispatch_5 = Dispatch(List=cull_6, DispatchPattern=findstring_3)  # -> ListA, ListB
dispatch_6 = Dispatch(List=pt_9, DispatchPattern=findstring_3)  # -> ListA, ListB
split_7 = TextSplit(Text=dispatch_5.ListA, Separators=",")
item_13 = ListItem(List=split_7, Index=0, Wrap=True)  # -> Item, Item1
split_8 = TextSplit(Text=item_13.Item1, Separators="_")

panel_31 = Panel(findstring_3)
panel_32 = Panel(twitter_6.Message)

cull_7 = CullPattern(List=twitter_6.Location, CullPattern=twitter_6.hasGeo)
cull_8 = CullPattern(List=twitter_6.Message, CullPattern=twitter_6.hasGeo)
pdecon_6 = Deconstruct(Point=cull_7)  # -> XComponent, YComponent, ZComponent
findstring_4 = SonicStringSearch(SearchPhrase="ADVS", TestToSearch=cull_8)
pt_10 = ConstructPoint(XCoordinate=pdecon_6.YComponent, YCoordinate=pdecon_6.XComponent, ZCoordinate=0)
dispatch_7 = Dispatch(List=cull_8, DispatchPattern=findstring_4)  # -> ListA, ListB
dispatch_8 = Dispatch(List=pt_10, DispatchPattern=findstring_4)  # -> ListA, ListB
split_9 = TextSplit(Text=dispatch_7.ListA, Separators=",")
item_14 = ListItem(List=split_9, Index=0, Wrap=True)  # -> Item, Item1
split_10 = TextSplit(Text=item_14.Item1, Separators="_")

# ---- group: SOB Value
item_15 = ListItem(List=split_8, Index=0, Wrap=True)  # -> Item, Item1, Item2, flatten(Item3)

# ---- group: SOB location
pt_11 = Point(dispatch_6.ListA)

# ----
pline_4 = PolyLine(Vertices=pt_9, Closed=False)

# ---- group: SOB Value
item_16 = ListItem(List=split_10, Index=0, Wrap=True)  # -> Item, Item1, Item2, flatten(Item3)

# ----
prox_3 = Proximity2D(Points=pt_9, Plane=PlaneXY(0, 0, 0), Group=Slider(8, range=0..10))  # -> Links, Topology
flatten_2 = FlattenTree(Tree=prox_3.Links, Path="{0}")
len_4 = Length(Curve=flatten_2)
bnd_9 = Bounds(Numbers=len_4)
dedomain_2 = DeconstructDomain(Domain=bnd_9)  # -> Start, End
gradient_2 = Gradient(
    LowerLimit=dedomain_2.Start,
    UpperLimit=dedomain_2.End,
    Parameter=len_4,
    stops=[0: RGB(217, 202, 205), 1: RGB(191, 19, 19)])
preview_2 = CustomPreview(Geometry=flatten_2, Shader=gradient_2)

pline_5 = PolyLine(Vertices=pt_11, Closed=False)

# ---- group: SOB location
pt_12 = Point(dispatch_8.ListA)

# ----
number_slider_6 = Slider(0.95, range=0..1)
eval_4 = EvaluateCurve(Curve=reparameterize(pline_4), Parameter=number_slider_6)  # -> Point, Tangent, Angle

# ---- group: Starting point
lng_2 = ListLength(List=pt_9)
item_17 = ListItem(List=pt_9, Index=lng_2, Wrap=True)

# ---- group: End point
item_18 = ListItem(List=pt_9, Index=0, Wrap=True)

# ---- group: Generating lines
eval_5 = EvaluateLength(Curve=pline_4, Length=number_slider_6, Normalized=True)  # -> Point, Tangent, Parameter
shatter_3 = Shatter(Curve=pline_4, Parameters=eval_5.Parameter)
item_19 = ListItem(List=shatter_3, Index=0, Wrap=True)
crv_6 = Curve(item_19)

# ----
pline_6 = PolyLine(Vertices=pt_10, Closed=False)

prox_4 = Proximity2D(Points=pt_10, Plane=PlaneXY(0, 0, 0), Group=Slider(8, range=0..10))  # -> Links, Topology
flatten_3 = FlattenTree(Tree=prox_4.Links, Path="{0}")
len_5 = Length(Curve=flatten_3)
bnd_10 = Bounds(Numbers=len_5)
dedomain_3 = DeconstructDomain(Domain=bnd_10)  # -> Start, End
gradient_3 = Gradient(
    LowerLimit=dedomain_3.Start,
    UpperLimit=dedomain_3.End,
    Parameter=len_5,
    stops=[0: RGB(217, 202, 205), 1: RGB(191, 19, 19)])
preview_3 = CustomPreview(Geometry=flatten_3, Shader=gradient_3)

pline_7 = PolyLine(Vertices=pt_12, Closed=False)

panel_39 = Panel(item_15.Item3)
len_6 = Length(Curve=pline_5)
panel_40 = Panel(item_16.Item3)
multiplication_2 = Multiplication(A=len_6, B=Slider(100000, range=0..100000))
panel_41 = Panel(len_6)
len_7 = Length(Curve=pline_7)
multiplication_3 = Multiplication(A=len_7, B=Slider(100000, range=0..100000))
panel_42 = Panel(len_7)

panel_43 = Panel("Circle Intensity Mapping")
bnd_11 = Bounds(Numbers=flatten(item_15.Item3))
dom_8 = ConstructDomain(DomainStart=Slider(0.0008, range=0..0.01), DomainEnd=Slider(0.0025, range=0..0.01))
remap_8 = RemapNumbers(Value=panel_39, Source=bnd_11, Target=dom_8)  # -> Mapped, Clipped
# if it' RED it means that there ae some tweets
# which are wrong (they are missing a comma...)
# please delete them from your twitter account
cir_5 = Circle(Plane=pt_11, Radius=remap_8.Mapped)

# ----
# if it' RED it means that there ae some tweets
# which are wrong (they are missing a comma...)
# please delete them from your twitter account
panel_44 = Panel("Circle Intensity Mapping")
bnd_12 = Bounds(Numbers=flatten(item_16.Item3))
dom_9 = ConstructDomain(DomainStart=Slider(0.0008, range=0..0.01), DomainEnd=Slider(0.0025, range=0..0.01))
remap_9 = RemapNumbers(Value=panel_40, Source=bnd_12, Target=dom_9)  # -> Mapped, Clipped
cir_6 = Circle(Plane=pt_12, Radius=remap_9.Mapped)

number_slider_7 = Slider(0.95, range=0..1)
eval_6 = EvaluateCurve(Curve=reparameterize(pline_6), Parameter=number_slider_7)  # -> Point, Tangent, Angle

# ---- group: Starting point
lng_3 = ListLength(List=pt_10)
item_20 = ListItem(List=pt_10, Index=lng_3, Wrap=True)

# ---- group: End point
item_21 = ListItem(List=pt_10, Index=0, Wrap=True)

# ---- group: Generating lines
eval_7 = EvaluateLength(Curve=pline_6, Length=number_slider_7, Normalized=True)  # -> Point, Tangent, Parameter
shatter_4 = Shatter(Curve=pline_6, Parameters=eval_7.Parameter)
item_22 = ListItem(List=shatter_4, Index=0, Wrap=True)
crv_7 = Curve(item_22)

# ----
pt_13 = Point(flatten([pt_7, pt_11, pt_6]))
panel_45 = Panel([panel_16, panel_29, panel_39])
panel_46 = Panel([item_6.Item3, int_3, item_16.Item3])
pt_14 = Point([pt_8, pt_5, pt_12])
panel_47 = Panel(pt_14)
panel_48 = Panel(pt_13)
pt_15 = Point(panel_48)
panel_49 = Panel(panel_45)
pt_16 = Point(flatten(panel_47))
panel_50 = Panel(panel_46)
