# Grasshopper definition 140521_invisible Cities_geoloc_group3.gh (Grasshopper 0.9.75)
# plug-ins: SonicTweet, SonicStringSearch

pt = Point([<point referenced from the Rhino model> x23])
pdecon = Deconstruct(Point=pt)  # -> XComponent, YComponent, ZComponent
pt_2 = ConstructPoint(XCoordinate=pdecon.XComponent, YCoordinate=pdecon.YComponent, ZCoordinate=0)

split = TextSplit(Text=pt_2, Separators="{}")
# this deletes the brackets
item = ListItem(List=split, Index=0, Wrap=True)  # -> Item, Item1, Item2, Item3

# ----
# Arts
crv = Curve([<curve referenced from the Rhino model> x34])
darc = DeconstructArc(Arc=crv)  # -> BasePlane, Radius, Angle
bnd = Bounds(Numbers=darc.Radius)
dom = ConstructDomain(DomainStart=Slider(0.0008, range=0..0.01), DomainEnd=Slider(0.0025, range=0..0.01))
pt_3 = Point(darc.BasePlane)
remap = RemapNumbers(Value=darc.Radius, Source=bnd, Target=dom)  # -> Mapped, Clipped
cir = Circle(Plane=pt_3, Radius=remap.Mapped)

split_2 = TextSplit(Text=pt_3, Separators="{}")
# this deletes the brackets
item_2 = ListItem(List=split_2, Index=0, Wrap=True)  # -> Item, Item1, Item2, Item3

panel = Panel(pt_2)
panel_2 = Panel(pt_3)
# username to look for
panel_3 = Panel("fusterpablo")
item_3 = ListItem(List=item.Item1, Index=0, Wrap=Slider(12, range=0..22))
item_4 = ListItem(List=item_2.Item1, Index=0, Wrap=Slider(10, range=0..33))
twitter = SonicTweet(Search="urbandriftpab1")  # -> Message, fromUser, toUser, Date, Location, hasGeo, ProfilePic, Followers, ID
twitter_2 = SonicTweet(Search=panel_3, nResults="37")  # -> Message, fromUser, toUser, Date, Location, hasGeo, ProfilePic, Followers, ID
split_3 = TextSplit(Text=item_3, Separators=",")
panel_4 = Panel(split_3)
cull_i = CullIndex(List=panel_4, Indices="2", Wrap=True)
split_4 = TextSplit(Text=item_4, Separators=",")
panel_5 = Panel(split_4)
cull_i_2 = CullIndex(List=panel_5, Indices="2", Wrap=True)
rev = ReverseList(List=cull_i)
bnd_2 = Bounds(Numbers=remap.Mapped)
panel_6 = Panel(remap.Mapped)
rev_2 = ReverseList(List=cull_i_2)
panel_7 = Panel(twitter.Message)
# estract specific tweet:
# here you can check the message of the tweet
# you are extracting and you can use the
#  location to plot into a map
panel_8 = Panel(twitter_2.Message)
dom_2 = ConstructDomain(DomainStart=Slider(1, range=0..4), DomainEnd=Slider(4, range=0..4))
item_5 = ListItem(List=twitter_2.Message, Index=0, Wrap=True)
item_6 = ListItem(List=twitter_2.Location, Index=0, Wrap=True)
remap_2 = RemapNumbers(Value=remap.Mapped, Source=bnd_2, Target=dom_2)  # -> Mapped, Clipped
# estract specific tweet:
# here you can check the message of the tweet
# you are extracting and you can use the
#  location to plot into a map
panel_9 = Panel(cull_i_2)
panel_10 = Panel(item_5)
panel_11 = Panel(remap_2.Mapped)

cull = CullPattern(List=twitter.Message, CullPattern=twitter.hasGeo)
cull_2 = CullPattern(List=twitter.Location, CullPattern=twitter.hasGeo)
pdecon_2 = Deconstruct(Point=cull_2)  # -> XComponent, YComponent, ZComponent
findstring = SonicStringSearch(SearchPhrase="ARTS", TestToSearch=cull)
pt_4 = ConstructPoint(XCoordinate=pdecon_2.YComponent, YCoordinate=pdecon_2.XComponent, ZCoordinate=0)
dispatch = Dispatch(List=cull, DispatchPattern=findstring)  # -> ListA, ListB
dispatch_2 = Dispatch(List=pt_4, DispatchPattern=findstring)  # -> ListA, ListB
split_5 = TextSplit(Text=dispatch.ListA, Separators=",")
item_7 = ListItem(List=split_5, Index=0, Wrap=True)  # -> Item, Item1
split_6 = TextSplit(Text=item_7.Item, Separators="_")

split_7 = TextSplit(Text=item_6, Separators=",")
item_8 = ListItem(List=rev, Index=0, Wrap=True)  # -> Item, Item1

# ----
# radius in Km
number_slider = Slider(2, range=0..5)

# ----
# word to look for
panel_12 = Panel("art&streetart&galleries&graffiti&painting")

int = Integer(panel_11)

# ----
# radius in Km
number_slider_2 = Slider(2, range=0..5)

item_9 = ListItem(List=rev_2, Index=0, Wrap=Slider(20, range=0..33))  # -> Item, Item1
panel_13 = Panel(int)

# ----
# word to look for
panel_14 = Panel("art&streetart&galleries&graffiti&painting")

twitter_3 = SonicTweet(Search=panel_12, GeoLat=item_8.Item, GeoLon=item_8.Item1, GeoRadius=number_slider, nResults=Slider(100, range=0..100))  # -> Message, fromUser, toUser, Date, Location, hasGeo, ProfilePic, Followers, ID
twitter_4 = SonicTweet(Search=panel_14, GeoLat=item_9.Item, GeoLon=item_9.Item1, GeoRadius=number_slider_2, nResults=Slider(100, range=0..100))  # -> Message, fromUser, toUser, Date, Location, hasGeo, ProfilePic, Followers, ID
item_10 = ListItem(List=split_7, Index=0, Wrap=True)  # -> Item, Item1

# ----
# radius in Km
number_slider_3 = Slider(2, range=0..5)

# ----
# word to look for
panel_15 = Panel("art&streetart&galleries&graffiti&painting")

panel_16 = Panel(twitter_3.Message)
pdecon_3 = Deconstruct(Point=twitter_3.Location)  # -> XComponent, YComponent, ZComponent
panel_17 = Panel(twitter_4.Message)
twitter_5 = SonicTweet(
    Search=panel_15,
    GeoLat=item_10.Item,
    GeoLon=item_10.Item1,
    GeoRadius=number_slider_3,
    nResults=Slider(100, range=0..100))  # -> Message, fromUser, toUser, Date, Location, hasGeo, ProfilePic, Followers, ID
pdecon_4 = Deconstruct(Point=twitter_4.Location)  # -> XComponent, YComponent, ZComponent

# ----
# slider for number of lines
number_slider_4 = Slider(0.04, range=0..0.04)

# ----
# point on map
pt_5 = ConstructPoint(XCoordinate=pdecon_3.YComponent, YCoordinate=pdecon_3.XComponent, ZCoordinate=0)

# ----
# slider for number of lines
number_slider_5 = Slider(0.04, range=0..0.04)

# ----
# point on map
pt_6 = ConstructPoint(XCoordinate=pdecon_4.YComponent, YCoordinate=pdecon_4.XComponent, ZCoordinate=0)

panel_18 = Panel(twitter_5.Message)

# ---- group: SiOB Value
item_11 = ListItem(List=split_6, Index=0, Wrap=True)  # -> Item, Item1, Item2, flatten(Item3)

# ----
clean = CleanTree(Tree=pt_5, CleanInvalid=True, CleanEmpty=True)

# ---- group: SiOB location
pt_7 = Point(dispatch_2.ListA)

# ----
split_8 = TextSplit(Text=pt_7, Separators="{}")
# this deletes the brackets
item_12 = ListItem(List=split_8, Index=0, Wrap=True)  # -> Item, Item1, Item2, Item3

pdecon_5 = Deconstruct(Point=twitter_5.Location)  # -> XComponent, YComponent, ZComponent
clean_2 = CleanTree(Tree=pt_6, CleanInvalid=True, CleanEmpty=True)
prox = Proximity3D(Points=clean, Group=5, MaxRadius=number_slider_4)  # -> flatten(Links), Topology

# ----
# slider for number of lines
number_slider_6 = Slider(0.04, range=0..0.04)

len = Length(Curve=prox.Links)

# ----
# point on map
pt_8 = ConstructPoint(XCoordinate=pdecon_5.YComponent, YCoordinate=pdecon_5.XComponent, ZCoordinate=0)

prox_2 = Proximity3D(Points=clean_2, Group=5, MaxRadius=number_slider_5)  # -> flatten(Links), Topology
len_2 = Length(Curve=prox_2.Links)
dom_3 = ConstructDomain(DomainStart=Slider(0, range=0..100), DomainEnd=Slider(7, range=0..10))
bnd_3 = Bounds(Numbers=len)
item_13 = ListItem(List=item_12.Item1, Index=0, Wrap=Slider(12, range=0..22))
clean_3 = CleanTree(Tree=pt_8, CleanInvalid=True, CleanEmpty=True)
dom_4 = ConstructDomain(DomainStart=Slider(0, range=0..100), DomainEnd=Slider(7, range=0..10))
bnd_4 = Bounds(Numbers=len_2)
remap_3 = RemapNumbers(Value=len, Source=bnd_3, Target=dom_3)  # -> Mapped, Clipped
crv_2 = Curve(prox.Links)
remap_4 = RemapNumbers(Value=len_2, Source=bnd_4, Target=dom_4)  # -> Mapped, Clipped

# ----
# layernames
panel_19 = Panel("network line_")

int_2 = Integer(remap_3.Mapped)
crv_3 = Curve(prox_2.Links)
prox_3 = Proximity3D(Points=clean_3, Group=5, MaxRadius=number_slider_6)  # -> flatten(Links), Topology
len_3 = Length(Curve=prox_3.Links)
# to bake the lines
toggle = BooleanToggle(False)
split_9 = TextSplit(Text=item_13, Separators=",")
panel_20 = Panel(split_9)
cull_i_3 = CullIndex(List=panel_20, Indices="2", Wrap=True)

# ----
# layernames
panel_21 = Panel("network line_")

int_3 = Integer(remap_4.Mapped)
rev_3 = ReverseList(List=cull_i_3)
# to bake the lines
toggle_2 = BooleanToggle(False)
dom_5 = ConstructDomain(DomainStart=Slider(0, range=0..100), DomainEnd=Slider(7, range=0..10))
concat = Concatenate(FragmentA=panel_19, FragmentB=int_2)
panel_22 = Panel(concat)
bnd_5 = Bounds(Numbers=len_3)
concat_2 = Concatenate(FragmentA=panel_21, FragmentB=int_3)
panel_23 = Panel(concat_2)
remap_5 = RemapNumbers(Value=len_3, Source=bnd_5, Target=dom_5)  # -> Mapped, Clipped
bakeattributes2 = BakeAttributes(obj=crv_2, layer=concat, activate=toggle)  # -> out; inputs obj: GeometryBase, name: String, layer: String, color: Color, pWidth: Double, wires: Int32, activate: Boolean
# ---------- bakeattributes2: C# ----------
    //Inserts geometry into the Rhino document, with custom attributes
    //Written by Giulio Piacentino
    //Version written 2010 11 21 - for Grasshopper 0.8.002

    if (activate)
    {
      if(obj == null)
      {
        Print("No object to bake");
        return;
      }

      //Make new attribute to set name
      Rhino.DocObjects.ObjectAttributes att = new Rhino.DocObjects.ObjectAttributes();

      //Set object name
      if(!string.IsNullOrEmpty(name))
      {
        att.Name = name;
      }

      //Set color
      if(!color.IsEmpty)
      {
        att.ColorSource = Rhino.DocObjects.ObjectColorSource.ColorFromObject; //Make the color type "by object"
        att.ObjectColor = color;

        att.PlotColorSource = Rhino.DocObjects.ObjectPlotColorSource.PlotColorFromObject; //Make the plot color type "by object"
        att.PlotColor = color;
      }

      //Set layer
      if(!string.IsNullOrEmpty(layer) && Rhino.DocObjects.Layer.IsValidName(layer))
      {
        //Get the current layer index
        Rhino.DocObjects.Tables.LayerTable layerTable = doc.Layers;
        //int layerIndex = layerTable.Find(layer, true);
        int layerIndex = layerTable.FindByFullPath(layer, true);

        if(layerIndex < 0) //This layer does not exist, we add it
        {
          Rhino.DocObjects.Layer onlayer = new Rhino.DocObjects.Layer(); //Make a new layer
          onlayer.Name = layer;

          layerIndex = layerTable.Add(onlayer); //Add the layer to the layer table
          if (layerIndex > -1) //We manged to add layer!
          {
            att.LayerIndex = layerIndex;
            Print("Added new layer to the document at position " + layerIndex + " named " + layer + ". ");
          } else
            Print("Layer did not add. Try cleaning up your layers."); //This never happened to me.
        }
        else
          att.LayerIndex = layerIndex; //We simply add to the existing layer
      }


      //Set plotweight
      if(pWidth > 0)
      {
        att.PlotWeightSource = Rhino.DocObjects.ObjectPlotWeightSource.PlotWeightFromObject;
        att.PlotWeight = pWidth;
      }


      //Set material
      bool materialByName = !string.IsNullOrEmpty(material as string);
      Rhino.Display.DisplayMaterial inMaterial = material as Rhino.Display.DisplayMaterial;
      if(material is Color)
      {
        inMaterial = new Rhino.Display.DisplayMaterial((Color) material);
      }
      if(material != null && inMaterial == null && !materialByName)
      {
        if(!(material is string))
        {
          try //We also resort to try with IConvertible
          {
            inMaterial = (Rhino.Display.DisplayMaterial) Convert.ChangeType(material, typeof(Rhino.Display.DisplayMaterial));
          }
          catch(InvalidCastException)
          {
          }
        }
      }
      if(inMaterial != null || materialByName)
      {
        string matName;

        if(!materialByName)
        {
          matName = string.Format("A:{0}-D:{1}-E:{2}-S:{3},{4}-T:{5}",
            Format(inMaterial.Ambient),
            Format(inMaterial.Diffuse),
            Format(inMaterial.Emission),
            Format(inMaterial.Specular),
            inMaterial.Shine.ToString(),
            inMaterial.Transparency.ToString()
            );
        }
        else
        {
          matName = (string) material;
        }

        int materialIndex = doc.Materials.Find(matName, true);
        if(materialIndex < 0 && !materialByName) //Material does not exist and we have its specs
        {
          materialIndex = doc.Materials.Add(); //Let's add it
          if(materialIndex > -1)
          {
            Print("Added new material at position " + materialIndex + " named \"" + matName + "\". ");
            Rhino.DocObjects.Material m = doc.Materials[materialIndex];
            m.Name = matName;
            m.AmbientColor = inMaterial.Ambient;
            m.DiffuseColor = inMaterial.Diffuse;
            m.EmissionColor = inMaterial.Emission;
            //m.ReflectionColor = no equivalent
            m.SpecularColor = inMaterial.Specular;
            m.Shine = inMaterial.Shine;
            m.Transparency = inMaterial.Transparency;
            //m.TransparentColor = no equivalent
            m.CommitChanges();

            att.MaterialSource = Rhino.DocObjects.ObjectMaterialSource.MaterialFromObject;
            att.MaterialIndex = materialIndex;
          }
          else
            Print("Material did not add. Try cleaning up your materials."); //This never happened to me.
        }
        else if(materialIndex < 0 && materialByName) //Material does not exist and we do not have its specs. We do nothing
        {
          Print("Warning: material name not found. I cannot set the source to this material name. Add a material with name: " + matName);
        }
        else
        {
          //If this material exists, we do not replace it!
          att.MaterialSource = Rhino.DocObjects.ObjectMaterialSource.MaterialFromObject;
          att.MaterialIndex = materialIndex;
        }
      }


      //Set wire density
      if(wires == -1 || wires > 0)
      {
        att.WireDensity = wires;
      }


      //Bake to the right type of object
      switch(obj.ObjectType)
      {
        case Rhino.DocObjects.ObjectType.Brep:
          doc.Objects.AddBrep(obj as Brep, att);
          break;
        case Rhino.DocObjects.ObjectType.Curve:
          doc.Objects.AddCurve(obj as Curve, att);
          break;
        case Rhino.DocObjects.ObjectType.Point:
          doc.Objects.AddPoint((obj as Rhino.Geometry.Point).Location, att);
          break;
        case Rhino.DocObjects.ObjectType.Surface:
          doc.Objects.AddSurface(obj as Surface, att);
          break;
        case Rhino.DocObjects.ObjectType.Mesh:
          doc.Objects.AddMesh(obj as Mesh, att);
          break;
        case Rhino.DocObjects.ObjectType.Extrusion:
          typeof(Rhino.DocObjects.Tables.ObjectTable).InvokeMember("AddExtrusion", BindingFlags.Instance | BindingFlags.InvokeMethod, null, doc.Objects, new object[]{obj, att});
          break;
        case Rhino.DocObjects.ObjectType.PointSet:
          doc.Objects.AddPointCloud(obj as Rhino.Geometry.PointCloud, att); //This is a speculative entry
          break;
        default:
          Print("The script does not know how to handle this type of geometry: " + obj.GetType().FullName);
          break;
      }
      Print("Added " + obj.GetType().Name);

    }
    else
    {
      Print("Inactive");
    }
# ---------- bakeattributes2: C# additional code ----------
  static string Format(Color c)
  {
    return (new System.Text.StringBuilder("A")).Append(c.A.ToString()).Append("R").Append(c.R.ToString()).Append("G")
      .Append(c.G.ToString()).Append("B").Append(c.B.ToString()).ToString();
  }
# ---------- end bakeattributes2 ----------
crv_4 = Curve(prox_3.Links)
bakeattributes2_2 = BakeAttributes(obj=crv_3, layer=concat_2, activate=toggle_2)  # -> out; inputs obj: GeometryBase, name: String, layer: String, color: Color, pWidth: Double, wires: Int32, activate: Boolean; same code as bakeattributes2

# ----
# radius in Km
number_slider_7 = Slider(2, range=0..5)

# ----
# layernames
panel_24 = Panel("network line_")

int_4 = Integer(remap_5.Mapped)
item_14 = ListItem(List=rev_3, Index=0, Wrap=True)  # -> Item, Item1
# to bake the lines
toggle_3 = BooleanToggle(False)

# ----
# word to look for
panel_25 = Panel("art&streetart&galleries&graffiti&painting")

panel_26 = Panel(bakeattributes2)
concat_3 = Concatenate(FragmentA=panel_24, FragmentB=int_4)
panel_27 = Panel(concat_3)
panel_28 = Panel(bakeattributes2_2)
twitter_6 = SonicTweet(
    Search=panel_25,
    GeoLat=item_14.Item,
    GeoLon=item_14.Item1,
    GeoRadius=number_slider_7,
    nResults=Slider(100, range=0..100))  # -> Message, fromUser, toUser, Date, Location, hasGeo, ProfilePic, Followers, ID
bakeattributes2_3 = BakeAttributes(obj=crv_4, layer=concat_3, activate=toggle_3)  # -> out; inputs obj: GeometryBase, name: String, layer: String, color: Color, pWidth: Double, wires: Int32, activate: Boolean; same code as bakeattributes2
panel_29 = Panel(bakeattributes2_3)
panel_30 = Panel(twitter_6.Message)
pdecon_6 = Deconstruct(Point=twitter_6.Location)  # -> XComponent, YComponent, ZComponent

# ----
# slider for number of lines
number_slider_8 = Slider(0.04, range=0..0.04)

# ----
# point on map
pt_9 = ConstructPoint(XCoordinate=pdecon_6.YComponent, YCoordinate=pdecon_6.XComponent, ZCoordinate=0)

clean_4 = CleanTree(Tree=pt_9, CleanInvalid=True, CleanEmpty=True)
prox_4 = Proximity3D(Points=clean_4, Group=5, MaxRadius=number_slider_8)  # -> flatten(Links), Topology
len_4 = Length(Curve=prox_4.Links)
dom_6 = ConstructDomain(DomainStart=Slider(0, range=0..100), DomainEnd=Slider(7, range=0..10))
bnd_6 = Bounds(Numbers=len_4)
remap_6 = RemapNumbers(Value=len_4, Source=bnd_6, Target=dom_6)  # -> Mapped, Clipped
crv_5 = Curve(prox_4.Links)

# ----
# layernames
panel_31 = Panel("network line_")

int_5 = Integer(remap_6.Mapped)
# to bake the lines
toggle_4 = BooleanToggle(False)
concat_4 = Concatenate(FragmentA=panel_31, FragmentB=int_5)
panel_32 = Panel(concat_4)
bakeattributes2_4 = BakeAttributes(obj=crv_5, layer=concat_4, activate=toggle_4)  # -> out; inputs obj: GeometryBase, name: String, layer: String, color: Color, pWidth: Double, wires: Int32, activate: Boolean; same code as bakeattributes2
panel_33 = Panel(bakeattributes2_4)
