# Grasshopper definition 140521_invisible Cities_geoloctwitter.gh (Grasshopper 0.9.75)
# plug-ins: SonicTweet, SonicStringSearch

# ---- group: Group 2
# username to look for
panel = Panel("urbandriftpab1")
panel_2 = Panel("urbandriftmyo1")

# ----
# estract specific tweet:
# here you can check the message of the tweet
# you are extracting and you can use the
#  location to plot into a map
twitter = SonicTweet(Search=panel, nResults="37")  # -> Message, fromUser, toUser, Date, Location, hasGeo, ProfilePic, Followers, ID
number_slider = Slider(30, range=0..30)

# ---- group: Group 2
# username to look for
panel_3 = Panel("urbandriftpab1")
panel_4 = Panel("urbandriftmyo1")

# ----
panel_5 = Panel(twitter.Message)
item = ListItem(List=twitter.Message, Index=number_slider, Wrap=True)
item_2 = ListItem(List=twitter.Location, Index=number_slider, Wrap=True)
# estract specific tweet:
# here you can check the message of the tweet
# you are extracting and you can use the
#  location to plot into a map
twitter_2 = SonicTweet(Search=panel_4, nResults="17")  # -> Message, fromUser, toUser, Date, Location, hasGeo, ProfilePic, Followers, ID
number_slider_2 = Slider(14, range=0..14)
panel_6 = Panel(item)
split = TextSplit(Text=item_2, Separators=",")
panel_7 = Panel(twitter_2.Message)
item_3 = ListItem(List=twitter_2.Message, Index=number_slider_2, Wrap=True)
item_4 = ListItem(List=twitter_2.Location, Index=number_slider_2, Wrap=True)

# ----
# radius in Km
number_slider_3 = Slider(2, range=0..5)

item_5 = ListItem(List=split, Index=0, Wrap=True)  # -> Item, Item1

# ----
# word to look for
panel_8 = Panel("art OR gallery OR creative OR painting OR streetart OR artistic OR graffiti OR colorful OR exhibition")

panel_9 = Panel(item_3)

# ---- group: Group 2
panel_10 = Panel("urbandriftpab1")

# ----
twitter_3 = SonicTweet(Search=panel_8, GeoLat=item_5.Item, GeoLon=item_5.Item1, GeoRadius=number_slider_3, nResults="200")  # -> Message, fromUser, toUser, Date, Location, hasGeo, ProfilePic, Followers, ID
split_2 = TextSplit(Text=item_4, Separators=",")

# ----
# radius in Km
number_slider_4 = Slider(2, range=0..5)

item_6 = ListItem(List=split_2, Index=0, Wrap=True)  # -> Item, Item1

# ----
# word to look for
panel_12 = Panel("art OR gallery OR creative OR painting OR streetart OR artistic OR graffiti OR colorful OR exhibition")

panel_13 = Panel(twitter_3.Message)
pdecon = Deconstruct(Point=twitter_3.Location)  # -> XComponent, YComponent, ZComponent

# ---- group: Group 2
panel_14 = Panel("urbandriftpab1")
panel_15 = Panel("urbandriftmyo1")

# ----
twitter_4 = SonicTweet(Search=panel_10, nResults=Slider(35, range=0..100))  # -> Message, fromUser, toUser, Date, Location, hasGeo, ProfilePic, Followers, ID
twitter_5 = SonicTweet(Search=panel_12, GeoLat=item_6.Item, GeoLon=item_6.Item1, GeoRadius=number_slider_4, nResults="200")  # -> Message, fromUser, toUser, Date, Location, hasGeo, ProfilePic, Followers, ID
pdecon_2 = Deconstruct(Point=twitter_4.Location)  # -> XComponent, YComponent, ZComponent
null = NullItem(Item=pdecon_2.XComponent)  # -> NullFlags, InvalidFlags, Description

# ----
# point on map
pt = ConstructPoint(XCoordinate=pdecon.YComponent, YCoordinate=pdecon.XComponent, ZCoordinate=0)

panel_16 = Panel(twitter_5.Message)
pdecon_3 = Deconstruct(Point=twitter_5.Location)  # -> XComponent, YComponent, ZComponent
dispatch = Dispatch(List=twitter_4.Message, DispatchPattern=null.NullFlags)  # -> ListA, ListB
dispatch_2 = Dispatch(List=twitter_4.Location, DispatchPattern=null.NullFlags)  # -> ListA, ListB
twitter_6 = SonicTweet(Search=panel_15, nResults=Slider(17, range=0..17))  # -> Message, fromUser, toUser, Date, Location, hasGeo, ProfilePic, Followers, ID
pdecon_4 = Deconstruct(Point=twitter_6.Location)  # -> XComponent, YComponent, ZComponent

message = Panel(dispatch.ListB)
panel_17 = Panel("seach text component")
findstring = SonicStringSearch(SearchPhrase="ARTS_", TestToSearch=message, CaseSensitive=Toggle(True))
panel_18 = Panel(findstring)
dispatch_3 = Dispatch(List=message, DispatchPattern=findstring)  # -> ListA, ListB
panel_19 = Panel(dispatch_3.ListB)
panel_20 = Panel(dispatch_3.ListA)

pdecon_5 = Deconstruct(Point=dispatch_2.ListB)  # -> XComponent, YComponent, ZComponent
null_2 = NullItem(Item=pdecon_4.XComponent)  # -> NullFlags, InvalidFlags, Description

# ----
# point on map
pt_2 = ConstructPoint(XCoordinate=pdecon_3.YComponent, YCoordinate=pdecon_3.XComponent, ZCoordinate=0)

pt_3 = ConstructPoint(XCoordinate=pdecon_5.YComponent, YCoordinate=pdecon_5.XComponent, ZCoordinate=0)
item_7 = ListItem(List=pt_3, Index=Slider(30, range=0..30), Wrap=True)
ln = Line(StartPoint=pt, EndPoint=item_7)
item_8 = ListItem(List=pt_3, Index=Slider(30, range=0..100), Wrap=True)
dispatch_4 = Dispatch(List=twitter_6.Message, DispatchPattern=null_2.NullFlags)  # -> ListA, ListB
dispatch_5 = Dispatch(List=twitter_6.Location, DispatchPattern=null_2.NullFlags)  # -> ListA, ListB
points = PointList(Points=pt_3, Size=Slider(0.0002, range=0..0.01))
panel_21 = Panel(pt_3)
panel_22 = Panel(item_7)

message_2 = Panel(dispatch_4.ListB)
findstring_2 = SonicStringSearch(SearchPhrase="Arts_", TestToSearch=message_2, CaseSensitive=Toggle(True))
panel_24 = Panel(findstring_2)
dispatch_6 = Dispatch(List=message_2, DispatchPattern=findstring_2)  # -> ListA, ListB
panel_25 = Panel(dispatch_6.ListB)
panel_26 = Panel(dispatch_6.ListA)

pdecon_6 = Deconstruct(Point=dispatch_5.ListB)  # -> XComponent, YComponent, ZComponent
pt_4 = ConstructPoint(XCoordinate=pdecon_6.YComponent, YCoordinate=pdecon_6.XComponent, ZCoordinate=0)
item_9 = ListItem(List=pt_4, Index=Slider(14, range=0..17), Wrap=True)
ln_2 = Line(StartPoint=pt_2, EndPoint=item_9)
item_10 = ListItem(List=pt_4, Index=Slider(100, range=0..100), Wrap=True)
pt_5 = Point(pt_3)
points_2 = PointList(Points=pt_4, Size=Slider(0.0002, range=0..0.01))
panel_27 = Panel(pt_4)
panel_28 = Panel(item_9)
flatten = FlattenTree(Tree=pt_5, Path="{0}")

panel_29 = Panel("Drift Frequency")
prox = Proximity2D(Points=flatten, Plane=PlaneXY(0, 0, 0), Group=Slider(5, range=0..10))  # -> Links, Topology
flatten_2 = FlattenTree(Tree=prox.Links, Path="{0}")
len = Length(Curve=flatten_2)
bnd = Bounds(Numbers=len)
dedomain = DeconstructDomain(Domain=bnd)  # -> Start, End
gradient = Gradient(LowerLimit=dedomain.Start, UpperLimit=dedomain.End, Parameter=len, stops=[0: RGB(217, 202, 205), 1: RGB(191, 19, 19)])
preview = CustomPreview(Geometry=flatten_2, Shader=gradient)

pt_6 = Point(pt_4)

panel_30 = Panel("Total Drift Route")
pline = PolyLine(Vertices=flatten, Closed=False)

flatten_3 = FlattenTree(Tree=pt_6, Path="{0}")

prox_2 = Proximity2D(Points=flatten_3, Plane=PlaneXY(0, 0, 0), Group=Slider(5, range=0..10))  # -> Links, Topology
flatten_4 = FlattenTree(Tree=prox_2.Links, Path="{0}")
len_2 = Length(Curve=flatten_4)
bnd_2 = Bounds(Numbers=len_2)
dedomain_2 = DeconstructDomain(Domain=bnd_2)  # -> Start, End
gradient_2 = Gradient(
    LowerLimit=dedomain_2.Start,
    UpperLimit=dedomain_2.End,
    Parameter=len_2,
    stops=[0: RGB(217, 202, 205), 1: RGB(191, 19, 19)])
preview_2 = CustomPreview(Geometry=flatten_4, Shader=gradient_2)

flip = FlipCurve(Curve=pline)  # -> Curve, Flag
split_3 = TextSplit(Text=panel_20, Separators="_")
eval = EvaluateCurve(Curve=reparameterize(flip.Curve), Parameter=Slider(1, range=0..1))  # -> Point, Tangent, Angle
panel_32 = Panel(split_3)

pline_2 = PolyLine(Vertices=flatten_3, Closed=False)

dispatch_7 = Dispatch(List=flatten, DispatchPattern=findstring)  # -> ListA, ListB
flip_2 = FlipCurve(Curve=pline_2)  # -> Curve, Flag
flatten_5 = FlattenTree(Tree=dispatch_7.ListA, Path="{0}")

panel_34 = Panel("Values Extraction")
item_11 = ListItem(List=split_3, Index=0, Wrap=True)  # -> Item, flatten(Item1), flatten(Item2)

split_4 = TextSplit(Text=panel_26, Separators="_")
pt_7 = Point(flatten_5)
eval_2 = EvaluateCurve(Curve=reparameterize(flip_2.Curve), Parameter=Slider(1, range=0..1))  # -> Point, Tangent, Angle
panel_35 = Panel(split_4)
item_12 = ListItem(List=pt_7, Index=Slider(5, range=0..10), Wrap=True)
dispatch_8 = Dispatch(List=flatten_3, DispatchPattern=findstring_2)  # -> ListA, ListB
date = Panel(item_11.Item2)
flatten_6 = FlattenTree(Tree=dispatch_8.ListA, Path="{0}")

item_13 = ListItem(List=split_4, Index=0, Wrap=True)  # -> Item, flatten(Item1), flatten(Item2)

pt_8 = Point(flatten_6)
item_14 = ListItem(List=pt_8, Index=Slider(5, range=0..10), Wrap=True)

panel_37 = Panel("Specific Drift Route")
pline_3 = PolyLine(Vertices=pt_7, Closed=False)

date_2 = Panel(item_13.Item2)

panel_38 = Panel("Circle Intensity Mapping")
bnd_3 = Bounds(Numbers=flatten(item_11.Item2))
dom = ConstructDomain(DomainStart=Slider(0.00035, range=0..0.01), DomainEnd=Slider(0.00035, range=0..0.01))
remap = RemapNumbers(Value=item_11.Item2, Source=bnd_3, Target=dom)  # -> Mapped, Clipped
cir = Circle(Plane=pt_7, Radius=remap.Mapped)

pline_4 = PolyLine(Vertices=pt_8, Closed=False)

bnd_4 = Bounds(Numbers=flatten(item_13.Item2))
dom_2 = ConstructDomain(DomainStart=Slider(0.00035, range=0..0.01), DomainEnd=Slider(0.00035, range=0..0.01))
remap_2 = RemapNumbers(Value=item_13.Item2, Source=bnd_4, Target=dom_2)  # -> Mapped, Clipped
cir_2 = Circle(Plane=pt_8, Radius=remap_2.Mapped)
