# Grasshopper definition 140521_invisible Cities_geoloctwitter_network.gh (Grasshopper 0.9.75)
# plug-ins: SonicTweet

# ---- group: Group 2
# username to look for
panel = Panel("urbandriftmyo1")
panel_2 = Panel("urbandriftpab1")

# username to look for
panel_3 = Panel("urbandriftpab1")
panel_4 = Panel("urbandriftmyo1")

# ----
# estract specific tweet:
# here you can check the message of the tweet
# you are extracting and you can use the
#  location to plot into a map
twitter = SonicTweet(Search=panel_2, nResults="37")  # -> Message, fromUser, toUser, Date, Location, hasGeo, ProfilePic, Followers, ID
# PAB ART SECOND DRIFT
panel_5 = Panel(twitter.Message)
merge = Merge(Data1=Slider(29, range=0..30), Data2=Slider(21, range=0..30), Data3=Slider(18, range=0..30))
# estract specific tweet:
# here you can check the message of the tweet
# you are extracting and you can use the
#  location to plot into a map
twitter_2 = SonicTweet(Search=panel_4, nResults="17")  # -> Message, fromUser, toUser, Date, Location, hasGeo, ProfilePic, Followers, ID
# MYO ART SECOND DRIFT
panel_6 = Panel(twitter_2.Message)

# ----
# Arts
crv = Curve([<curve referenced from the Rhino model> x34])
darc = DeconstructArc(Arc=crv)  # -> BasePlane, Radius, Angle
bnd = Bounds(Numbers=darc.Radius)
dom = ConstructDomain(DomainStart=Slider(0.0008, range=0..0.01), DomainEnd=Slider(0.0025, range=0..0.01))
pt = Point(darc.BasePlane)
remap = RemapNumbers(Value=darc.Radius, Source=bnd, Target=dom)  # -> Mapped, Clipped
cir = Circle(Plane=pt, Radius=remap.Mapped)

# ----
# All ART FIRST DRIFT
panel_7 = Panel("{}")
split = TextSplit(Text=pt, Separators=panel_7)
# this deletes the brackets
item = ListItem(List=split, Index=0, Wrap=True)  # -> Item, flatten(Item1), Item2, Item3
panel_8 = Panel(item.Item1)

# ----
# ADs
crv_2 = Curve([<curve referenced from the Rhino model> x17])
darc_2 = DeconstructArc(Arc=crv_2)  # -> BasePlane, Radius, Angle
bnd_2 = Bounds(Numbers=darc_2.Radius)
dom_2 = ConstructDomain(DomainStart=Slider(0.0008, range=0..0.01), DomainEnd=Slider(0.0025, range=0..0.01))
pt_2 = Point(darc_2.BasePlane)
remap_2 = RemapNumbers(Value=darc_2.Radius, Source=bnd_2, Target=dom_2)  # -> Mapped, Clipped
cir_2 = Circle(Plane=pt_2, Radius=remap_2.Mapped)

split_2 = TextSplit(Text=pt_2, Separators="{}")
# this deletes the brackets
item_2 = ListItem(List=split_2, Index=0, Wrap=True)  # -> Item, flatten(Item1), Item2, Item3
panel_9 = Panel(item_2.Item1)

merge_2 = Merge(Data1=Slider(17, range=0..17), Data2=Slider(10, range=0..17), Data3=Slider(3, range=0..17))
item_3 = ListItem(List=twitter.Message, Index=merge, Wrap=True)
item_4 = ListItem(List=twitter.Location, Index=merge, Wrap=True)
panel_10 = Panel(item_4)
panel_11 = Panel(twitter.Location)
pdecon = Deconstruct(Point=item_4)  # -> XComponent, YComponent, ZComponent
item_5 = ListItem(List=twitter_2.Message, Index=merge_2, Wrap=True)
item_6 = ListItem(List=twitter_2.Location, Index=merge_2, Wrap=True)
panel_12 = Panel(item_3)
panel_13 = Panel(item_6)
pdecon_2 = Deconstruct(Point=item_6)  # -> XComponent, YComponent, ZComponent

# ----
# Points
pt_3 = ConstructPoint(XCoordinate=pdecon.YComponent, YCoordinate=pdecon.XComponent, ZCoordinate=0)

panel_14 = Panel(item_5)
split_3 = TextSplit(Text=item_4, Separators=",")

# ----
# Points
pt_4 = ConstructPoint(XCoordinate=pdecon_2.YComponent, YCoordinate=pdecon_2.XComponent, ZCoordinate=0)

split_4 = TextSplit(Text=item_6, Separators=",")
panel_15 = Panel(split_3)
bnd_3 = Bounds(Numbers=remap_2.Mapped)

# ----
# radius in Km
number_slider = Slider(3, range=0..5)

item_7 = ListItem(List=split_3, Index=0, Wrap=True)  # -> Item, Item1
dom_3 = ConstructDomain(DomainStart=Slider(1, range=0..4), DomainEnd=Slider(4, range=0..4))

# ----
# word to look for
panel_16 = Panel("art OR gallery OR creative OR painting OR streetart OR artistic OR graffiti OR colorful OR exhibition")

bnd_4 = Bounds(Numbers=remap.Mapped)
panel_17 = Panel(remap.Mapped)
remap_3 = RemapNumbers(Value=remap_2.Mapped, Source=bnd_3, Target=dom_3)  # -> flatten(Mapped), Clipped
# estract specific tweet:
# here you can check the message of the tweet
# you are extracting and you can use the
#  location to plot into a map
dom_4 = ConstructDomain(DomainStart=Slider(1, range=0..4), DomainEnd=Slider(4, range=0..4))
# estract specific tweet:
# here you can check the message of the tweet
# you are extracting and you can use the
#  location to plot into a map
item_8 = ListItem(List=item.Item1, Index=0, Wrap=Slider(10, range=0..33))

split_5 = TextSplit(Text=item_8, Separators=",")
panel_18 = Panel(split_5)
cull_i = CullIndex(List=panel_18, Indices="2", Wrap=True)
rev = ReverseList(List=cull_i)

panel_19 = Panel(remap_3.Mapped)
remap_4 = RemapNumbers(Value=remap.Mapped, Source=bnd_4, Target=dom_4)  # -> Mapped, Clipped

# ----
# radius in Km
number_slider_2 = Slider(3, range=0..5)

panel_20 = Panel(remap_4.Mapped)
item_9 = ListItem(List=split_4, Index=0, Wrap=True)  # -> Item, Item1

# ----
# word to look for
panel_21 = Panel("art OR gallery OR creative OR painting OR streetart OR artistic OR graffiti OR colorful OR exhibition")

twitter_3 = SonicTweet(Search=panel_16, GeoLat=item_7.Item, GeoLon=item_7.Item1, GeoRadius=number_slider, nResults="200")  # -> Message, fromUser, toUser, Date, Location, hasGeo, ProfilePic, Followers, ID
item_10 = ListItem(List=item_2.Item1, Index=0, Wrap=True)

split_6 = TextSplit(Text=item_10, Separators=",")
panel_22 = Panel(split_6)
cull_i_2 = CullIndex(List=panel_22, Indices="2", Wrap=True)
rev_2 = ReverseList(List=cull_i_2)

int = Integer(flatten(panel_19))
panel_23 = Panel(int)
int_2 = Integer(panel_20)

# ----
# radius in Km
number_slider_3 = Slider(2, range=0..5)

item_11 = ListItem(List=rev, Index=0, Wrap=Slider(20, range=0..33))  # -> Item, Item1
panel_24 = Panel(int_2)
pdecon_3 = Deconstruct(Point=twitter_3.Location)  # -> XComponent, YComponent, ZComponent

# ----
# word to look for
panel_25 = Panel("art&streetart&galleries&graffiti&painting")

panel_26 = Panel(twitter_3.Message)
twitter_4 = SonicTweet(Search=panel_21, GeoLat=item_9.Item, GeoLon=item_9.Item1, GeoRadius=number_slider_2, nResults="200")  # -> Message, fromUser, toUser, Date, Location, hasGeo, ProfilePic, Followers, ID

# ----
# slider for number of lines
number_slider_4 = Slider(1.7, range=0..10)

item_12 = ListItem(List=rev_2, Index=0, Wrap=True)  # -> Item, Item1

# ----
# point on map
pt_5 = ConstructPoint(XCoordinate=pdecon_3.YComponent, YCoordinate=pdecon_3.XComponent, ZCoordinate=0)  # -> flatten(Point)

twitter_5 = SonicTweet(
    Search=panel_25,
    GeoLat=item_11.Item,
    GeoLon=item_11.Item1,
    GeoRadius=number_slider_3,
    nResults=Slider(100, range=0..100))  # -> Message, fromUser, toUser, Date, Location, hasGeo, ProfilePic, Followers, ID

# ----
# radius in Km
number_slider_5 = Slider(2, range=0..5)

# ----
# word to look for
panel_27 = Panel("art&streetart&galleries&graffiti&painting")

pdecon_4 = Deconstruct(Point=twitter_4.Location)  # -> XComponent, YComponent, ZComponent
panel_28 = Panel(twitter_4.Message)
clean = CleanTree(Tree=pt_5, CleanInvalid=True, CleanEmpty=True)
twitter_6 = SonicTweet(
    Search=panel_27,
    GeoLat=item_12.Item,
    GeoLon=item_12.Item1,
    GeoRadius=number_slider_5,
    nResults=Slider(100, range=0..100))  # -> Message, fromUser, toUser, Date, Location, hasGeo, ProfilePic, Followers, ID
panel_29 = Panel(twitter_5.Message)

# ----
# slider for number of lines
number_slider_6 = Slider(0.04, range=0..0.04)

# ----
# point on map
pt_6 = ConstructPoint(XCoordinate=pdecon_4.YComponent, YCoordinate=pdecon_4.XComponent, ZCoordinate=0)  # -> flatten(Point)

pdecon_5 = Deconstruct(Point=twitter_5.Location)  # -> XComponent, YComponent, ZComponent
prox = Proximity3D(Points=clean, Group=Slider(40, range=1..100), MaxRadius=Slider(0.05, range=0..0.05))  # -> flatten(Links), Topology
len = Length(Curve=prox.Links)
clean_2 = CleanTree(Tree=pt_6, CleanInvalid=True, CleanEmpty=True)
dom_5 = ConstructDomain(DomainStart=Slider(0, range=0..100), DomainEnd=Slider(7, range=0..10))
bnd_5 = Bounds(Numbers=len)
panel_30 = Panel(twitter_6.Message)

# ----
# point on map
pt_7 = ConstructPoint(XCoordinate=pdecon_5.YComponent, YCoordinate=pdecon_5.XComponent, ZCoordinate=0)

pdecon_6 = Deconstruct(Point=twitter_6.Location)  # -> XComponent, YComponent, ZComponent

# ----
# slider for number of lines
number_slider_7 = Slider(0.04, range=0..0.04)

remap_5 = RemapNumbers(Value=len, Source=bnd_5, Target=dom_5)  # -> Mapped, Clipped
crv_3 = Curve(prox.Links)
prox_2 = Proximity3D(Points=clean_2, Group=5, MaxRadius=number_slider_6)  # -> flatten(Links), Topology
len_2 = Length(Curve=prox_2.Links)

# ----
# layernames
panel_31 = Panel("network line_")

int_3 = Integer(remap_5.Mapped)

# ----
# point on map
pt_8 = ConstructPoint(XCoordinate=pdecon_6.YComponent, YCoordinate=pdecon_6.XComponent, ZCoordinate=0)

clean_3 = CleanTree(Tree=pt_7, CleanInvalid=True, CleanEmpty=True)
# to bake the lines
toggle = BooleanToggle(False)
dom_6 = ConstructDomain(DomainStart=Slider(0, range=0..100), DomainEnd=Slider(7, range=0..10))
bnd_6 = Bounds(Numbers=len_2)

# ----
# slider for number of lines
number_slider_8 = Slider(0.04, range=0..0.04)

concat = Concatenate(FragmentA=panel_31, FragmentB=int_3)
panel_32 = Panel(concat)
remap_6 = RemapNumbers(Value=len_2, Source=bnd_6, Target=dom_6)  # -> Mapped, Clipped
crv_4 = Curve(prox_2.Links)
prox_3 = Proximity3D(Points=clean_3, Group=5, MaxRadius=number_slider_7)  # -> flatten(Links), Topology
len_3 = Length(Curve=prox_3.Links)
clean_4 = CleanTree(Tree=pt_8, CleanInvalid=True, CleanEmpty=True)
bakeattributes2 = BakeAttributes(obj=crv_3, layer=concat, activate=toggle)  # -> out; inputs obj: GeometryBase, name: String, layer: String, color: Color, pWidth: Double, wires: Int32, activate: Boolean
# ---------- bakeattributes2: C# ----------
    //Inserts geometry into the Rhino document, with custom attributes
    //Written by Giulio Piacentino
    //Version written 2010 11 21 - for Grasshopper 0.8.002

    if (activate)
    {
      if(obj == null)
      {
        Print("No object to bake");
        return;
      }

      //Make new attribute to set name
      Rhino.DocObjects.ObjectAttributes att = new Rhino.DocObjects.ObjectAttributes();

      //Set object name
      if(!string.IsNullOrEmpty(name))
      {
        att.Name = name;
      }

      //Set color
      if(!color.IsEmpty)
      {
        att.ColorSource = Rhino.DocObjects.ObjectColorSource.ColorFromObject; //Make the color type "by object"
        att.ObjectColor = color;

        att.PlotColorSource = Rhino.DocObjects.ObjectPlotColorSource.PlotColorFromObject; //Make the plot color type "by object"
        att.PlotColor = color;
      }

      //Set layer
      if(!string.IsNullOrEmpty(layer) && Rhino.DocObjects.Layer.IsValidName(layer))
      {
        //Get the current layer index
        Rhino.DocObjects.Tables.LayerTable layerTable = doc.Layers;
        //int layerIndex = layerTable.Find(layer, true);
        int layerIndex = layerTable.FindByFullPath(layer, true);

        if(layerIndex < 0) //This layer does not exist, we add it
        {
          Rhino.DocObjects.Layer onlayer = new Rhino.DocObjects.Layer(); //Make a new layer
          onlayer.Name = layer;

          layerIndex = layerTable.Add(onlayer); //Add the layer to the layer table
          if (layerIndex > -1) //We manged to add layer!
          {
            att.LayerIndex = layerIndex;
            Print("Added new layer to the document at position " + layerIndex + " named " + layer + ". ");
          } else
            Print("Layer did not add. Try cleaning up your layers."); //This never happened to me.
        }
        else
          att.LayerIndex = layerIndex; //We simply add to the existing layer
      }


      //Set plotweight
      if(pWidth > 0)
      {
        att.PlotWeightSource = Rhino.DocObjects.ObjectPlotWeightSource.PlotWeightFromObject;
        att.PlotWeight = pWidth;
      }


      //Set material
      bool materialByName = !string.IsNullOrEmpty(material as string);
      Rhino.Display.DisplayMaterial inMaterial = material as Rhino.Display.DisplayMaterial;
      if(material is Color)
      {
        inMaterial = new Rhino.Display.DisplayMaterial((Color) material);
      }
      if(material != null && inMaterial == null && !materialByName)
      {
        if(!(material is string))
        {
          try //We also resort to try with IConvertible
          {
            inMaterial = (Rhino.Display.DisplayMaterial) Convert.ChangeType(material, typeof(Rhino.Display.DisplayMaterial));
          }
          catch(InvalidCastException)
          {
          }
        }
      }
      if(inMaterial != null || materialByName)
      {
        string matName;

        if(!materialByName)
        {
          matName = string.Format("A:{0}-D:{1}-E:{2}-S:{3},{4}-T:{5}",
            Format(inMaterial.Ambient),
            Format(inMaterial.Diffuse),
            Format(inMaterial.Emission),
            Format(inMaterial.Specular),
            inMaterial.Shine.ToString(),
            inMaterial.Transparency.ToString()
            );
        }
        else
        {
          matName = (string) material;
        }

        int materialIndex = doc.Materials.Find(matName, true);
        if(materialIndex < 0 && !materialByName) //Material does not exist and we have its specs
        {
          materialIndex = doc.Materials.Add(); //Let's add it
          if(materialIndex > -1)
          {
            Print("Added new material at position " + materialIndex + " named \"" + matName + "\". ");
            Rhino.DocObjects.Material m = doc.Materials[materialIndex];
            m.Name = matName;
            m.AmbientColor = inMaterial.Ambient;
            m.DiffuseColor = inMaterial.Diffuse;
            m.EmissionColor = inMaterial.Emission;
            //m.ReflectionColor = no equivalent
            m.SpecularColor = inMaterial.Specular;
            m.Shine = inMaterial.Shine;
            m.Transparency = inMaterial.Transparency;
            //m.TransparentColor = no equivalent
            m.CommitChanges();

            att.MaterialSource = Rhino.DocObjects.ObjectMaterialSource.MaterialFromObject;
            att.MaterialIndex = materialIndex;
          }
          else
            Print("Material did not add. Try cleaning up your materials."); //This never happened to me.
        }
        else if(materialIndex < 0 && materialByName) //Material does not exist and we do not have its specs. We do nothing
        {
          Print("Warning: material name not found. I cannot set the source to this material name. Add a material with name: " + matName);
        }
        else
        {
          //If this material exists, we do not replace it!
          att.MaterialSource = Rhino.DocObjects.ObjectMaterialSource.MaterialFromObject;
          att.MaterialIndex = materialIndex;
        }
      }


      //Set wire density
      if(wires == -1 || wires > 0)
      {
        att.WireDensity = wires;
      }


      //Bake to the right type of object
      switch(obj.ObjectType)
      {
        case Rhino.DocObjects.ObjectType.Brep:
          doc.Objects.AddBrep(obj as Brep, att);
          break;
        case Rhino.DocObjects.ObjectType.Curve:
          doc.Objects.AddCurve(obj as Curve, att);
          break;
        case Rhino.DocObjects.ObjectType.Point:
          doc.Objects.AddPoint((obj as Rhino.Geometry.Point).Location, att);
          break;
        case Rhino.DocObjects.ObjectType.Surface:
          doc.Objects.AddSurface(obj as Surface, att);
          break;
        case Rhino.DocObjects.ObjectType.Mesh:
          doc.Objects.AddMesh(obj as Mesh, att);
          break;
        case Rhino.DocObjects.ObjectType.Extrusion:
          typeof(Rhino.DocObjects.Tables.ObjectTable).InvokeMember("AddExtrusion", BindingFlags.Instance | BindingFlags.InvokeMethod, null, doc.Objects, new object[]{obj, att});
          break;
        case Rhino.DocObjects.ObjectType.PointSet:
          doc.Objects.AddPointCloud(obj as Rhino.Geometry.PointCloud, att); //This is a speculative entry
          break;
        default:
          Print("The script does not know how to handle this type of geometry: " + obj.GetType().FullName);
          break;
      }
      Print("Added " + obj.GetType().Name);

    }
    else
    {
      Print("Inactive");
    }
# ---------- bakeattributes2: C# additional code ----------
  static string Format(Color c)
  {
    return (new System.Text.StringBuilder("A")).Append(c.A.ToString()).Append("R").Append(c.R.ToString()).Append("G")
      .Append(c.G.ToString()).Append("B").Append(c.B.ToString()).ToString();
  }
# ---------- end bakeattributes2 ----------

# ----
# layernames
panel_33 = Panel("network line_")

int_4 = Integer(remap_6.Mapped)
# to bake the lines
toggle_2 = BooleanToggle(False)
dom_7 = ConstructDomain(DomainStart=Slider(0, range=0..100), DomainEnd=Slider(7, range=0..10))
bnd_7 = Bounds(Numbers=len_3)
concat_2 = Concatenate(FragmentA=panel_33, FragmentB=int_4)
panel_34 = Panel(concat_2)
prox_4 = Proximity3D(Points=clean_4, Group=5, MaxRadius=number_slider_8)  # -> flatten(Links), Topology
panel_35 = Panel(bakeattributes2)
remap_7 = RemapNumbers(Value=len_3, Source=bnd_7, Target=dom_7)  # -> Mapped, Clipped
len_4 = Length(Curve=prox_4.Links)
crv_5 = Curve(prox_3.Links)
bakeattributes2_2 = BakeAttributes(obj=crv_4, layer=concat_2, activate=toggle_2)  # -> out; inputs obj: GeometryBase, name: String, layer: String, color: Color, pWidth: Double, wires: Int32, activate: Boolean; same code as bakeattributes2
dom_8 = ConstructDomain(DomainStart=Slider(0, range=0..100), DomainEnd=Slider(7, range=0..10))

# ----
# layernames
panel_36 = Panel("network line_")

bnd_8 = Bounds(Numbers=len_4)
int_5 = Integer(remap_7.Mapped)
# to bake the lines
toggle_3 = BooleanToggle(False)
remap_8 = RemapNumbers(Value=len_4, Source=bnd_8, Target=dom_8)  # -> Mapped, Clipped
crv_6 = Curve(prox_4.Links)
concat_3 = Concatenate(FragmentA=panel_36, FragmentB=int_5)
panel_37 = Panel(concat_3)
panel_38 = Panel(bakeattributes2_2)

# ----
# layernames
panel_39 = Panel("network line_")

int_6 = Integer(remap_8.Mapped)
# to bake the lines
toggle_4 = BooleanToggle(False)
bakeattributes2_3 = BakeAttributes(obj=crv_5, layer=concat_3, activate=toggle_3)  # -> out; inputs obj: GeometryBase, name: String, layer: String, color: Color, pWidth: Double, wires: Int32, activate: Boolean; same code as bakeattributes2
concat_4 = Concatenate(FragmentA=panel_39, FragmentB=int_6)
panel_40 = Panel(concat_4)
panel_41 = Panel(bakeattributes2_3)
bakeattributes2_4 = BakeAttributes(obj=crv_6, layer=concat_4, activate=toggle_4)  # -> out; inputs obj: GeometryBase, name: String, layer: String, color: Color, pWidth: Double, wires: Int32, activate: Boolean; same code as bakeattributes2
panel_42 = Panel(bakeattributes2_4)
