# Grasshopper definition isovist.gh (Grasshopper 0.9.75)

geo = Geometry([<brep referenced from the Rhino model> x5])
geo_2 = Geometry(<curve referenced from the Rhino model>)
pt = Point(<point referenced from the Rhino model>)
bbx = BrepBrep(BrepA=geo, BrepB=geo_2)  # -> Curves, Points
ivist = IsoVist(Plane=pt, Count=Slider(98, range=0..250), Radius=Slider(53, range=0..250), Obstacles=flatten(bbx.Curves))  # -> Points, Distance, Index
ln = Line(StartPoint=pt, EndPoint=ivist.Points)
