# Grasshopper definition isovistGrasshopperTechnique.gh (Grasshopper 0.8.50)

# ---- group: Input Point
pt = Point()

# ---- group: Sampling and Radius control
samples = Slider(430, range=4..1024)
radius = Slider(50, range=1..100)

# ---- group: Input Polylines (Obstacles)
crv = Curve()

# ---- group: Optional point along route method
crv_2 = Curve()
curvepoint = PointOnCurve(crv_2, parameter=0)

# ---- group: Plane from point
pl = Plane(Origin=pt, XAxis=Vector(1, 0, 0), YAxis=Vector(0, 1, 0))

# ---- group: The isovist component
ivist = IsoVist(Plane=pl, Count=samples, Radius=radius, Obstacles=crv)  # -> Points, Distance, Hits

# ---- group: Polyline from Isovist points
pline = PolyLine(Vertices=ivist.Points, Closed=True)

# ---- group: Line from input point to isovist points
ln = Line()

# ---- group: Planar surface from polyline
planar = PlanarSrf(Edges=pline)
