# Grasshopper definition working progress.gh (Grasshopper 0.9.75)
# plug-ins: SonicTweet

pt = Point([<point referenced from the Rhino model> x99])
pt_2 = Point([<point referenced from the Rhino model> x23])
pdecon = Deconstruct(Point=pt)  # -> XComponent, YComponent, ZComponent
cir = Circle(Plane=pt, Radius=Slider(0.0001, range=0..0.01))
pdecon_2 = Deconstruct(Point=pt_2)  # -> XComponent, YComponent, ZComponent
cir_2 = Circle(Plane=PlaneXY(0, 0, 0), Radius=Slider(0.0001, range=0..0.01))

# ----
# Arts
crv = Curve([<curve referenced from the Rhino model> x34])
darc = DeconstructArc(Arc=crv)  # -> BasePlane, Radius, Angle
bnd = Bounds(Numbers=darc.Radius)
dom = ConstructDomain(DomainStart=Slider(0.0008, range=0..0.01), DomainEnd=Slider(0.0025, range=0..0.01))
pt_3 = Point(darc.BasePlane)
remap = RemapNumbers(Value=darc.Radius, Source=bnd, Target=dom)  # -> Mapped, Clipped
cir_3 = Circle(Plane=pt_3, Radius=remap.Mapped)

split = TextSplit(Text=pt_3, Separators="{}")
# this deletes the brackets
item = ListItem(List=split, Index=0, Wrap=True)  # -> Item, Item1, Item2, Item3

pt_4 = ConstructPoint(XCoordinate=pdecon.XComponent, YCoordinate=pdecon.YComponent, ZCoordinate=0)
panel = Panel(pt_3)
pt_5 = ConstructPoint(XCoordinate=pdecon_2.XComponent, YCoordinate=pdecon_2.YComponent, ZCoordinate=0)

split_2 = TextSplit(Text=pt_5, Separators="{}")
# this deletes the brackets
item_2 = ListItem(List=split_2, Index=0, Wrap=True)  # -> Item, Item1, Item2, Item3

# ----
# slider for number of lines
number_slider = Slider(0.04, range=0..0.04)

panel_2 = Panel(pt_5)
clean = CleanTree(Tree=pt_4, CleanInvalid=True, CleanEmpty=True)
item_3 = ListItem(List=item_2.Item1, Index=0, Wrap=Slider(12, range=0..22))
item_4 = ListItem(Index=0, Wrap=Slider(0.25, range=0..1))
prox = Proximity3D(Points=clean, Group=5, MaxRadius=number_slider)  # -> flatten(Links), Topology
len = Length(Curve=prox.Links)
cir_4 = Circle(Plane=pt_3, Radius=Slider(0.0001, range=0..0.01))
dom_2 = ConstructDomain(DomainStart=Slider(1, range=0..100), DomainEnd=Slider(5, range=0..10))
split_3 = TextSplit(Text=item_4, Separators=",")
panel_3 = Panel(split_3)
cull_i = CullIndex(List=panel_3, Indices="2", Wrap=True)
bnd_2 = Bounds(Numbers=len)
bnd_3 = Bounds(Numbers=remap.Mapped)
panel_4 = Panel(remap.Mapped)
split_4 = TextSplit(Text=item_3, Separators=",")
panel_5 = Panel(split_4)
cull_i_2 = CullIndex(List=panel_5, Indices="2", Wrap=True)
rev = ReverseList(List=cull_i)
rev_2 = ReverseList(List=cull_i_2)
remap_2 = RemapNumbers(Value=len, Source=bnd_2, Target=dom_2)  # -> Mapped, Clipped
dom_3 = ConstructDomain(DomainStart=Slider(1, range=0..4), DomainEnd=Slider(4, range=0..4))
crv_2 = Curve(prox.Links)
remap_3 = RemapNumbers(Value=remap.Mapped, Source=bnd_3, Target=dom_3)  # -> Mapped, Clipped
# estract specific tweet:
# here you can check the message of the tweet
# you are extracting and you can use the
#  location to plot into a map
panel_6 = Panel(cull_i)

# ----
# layernames
panel_7 = Panel("network line_")

int = Integer(remap_2.Mapped)
# to bake the lines
toggle = BooleanToggle(False)
panel_8 = Panel(remap_3.Mapped)
concat = Concatenate(FragmentA=panel_7, FragmentB=int)
panel_9 = Panel(concat)
int_2 = Integer(panel_8)

# ----
# radius in Km
number_slider_2 = Slider(5, range=0..5)

bakeattributes2 = BakeAttributes(obj=crv_2, layer=concat, activate=toggle)  # -> out; inputs obj: GeometryBase, name: String, layer: String, color: Color, pWidth: Double, wires: Int32, activate: Boolean
# ---------- bakeattributes2: C# ----------
    //Inserts geometry into the Rhino document, with custom attributes
    //Written by Giulio Piacentino
    //Version written 2010 11 21 - for Grasshopper 0.8.002

    if (activate)
    {
      if(obj == null)
      {
        Print("No object to bake");
        return;
      }

      //Make new attribute to set name
      Rhino.DocObjects.ObjectAttributes att = new Rhino.DocObjects.ObjectAttributes();

      //Set object name
      if(!string.IsNullOrEmpty(name))
      {
        att.Name = name;
      }

      //Set color
      if(!color.IsEmpty)
      {
        att.ColorSource = Rhino.DocObjects.ObjectColorSource.ColorFromObject; //Make the color type "by object"
        att.ObjectColor = color;

        att.PlotColorSource = Rhino.DocObjects.ObjectPlotColorSource.PlotColorFromObject; //Make the plot color type "by object"
        att.PlotColor = color;
      }

      //Set layer
      if(!string.IsNullOrEmpty(layer) && Rhino.DocObjects.Layer.IsValidName(layer))
      {
        //Get the current layer index
        Rhino.DocObjects.Tables.LayerTable layerTable = doc.Layers;
        //int layerIndex = layerTable.Find(layer, true);
        int layerIndex = layerTable.FindByFullPath(layer, true);

        if(layerIndex < 0) //This layer does not exist, we add it
        {
          Rhino.DocObjects.Layer onlayer = new Rhino.DocObjects.Layer(); //Make a new layer
          onlayer.Name = layer;

          layerIndex = layerTable.Add(onlayer); //Add the layer to the layer table
          if (layerIndex > -1) //We manged to add layer!
          {
            att.LayerIndex = layerIndex;
            Print("Added new layer to the document at position " + layerIndex + " named " + layer + ". ");
          } else
            Print("Layer did not add. Try cleaning up your layers."); //This never happened to me.
        }
        else
          att.LayerIndex = layerIndex; //We simply add to the existing layer
      }


      //Set plotweight
      if(pWidth > 0)
      {
        att.PlotWeightSource = Rhino.DocObjects.ObjectPlotWeightSource.PlotWeightFromObject;
        att.PlotWeight = pWidth;
      }


      //Set material
      bool materialByName = !string.IsNullOrEmpty(material as string);
      Rhino.Display.DisplayMaterial inMaterial = material as Rhino.Display.DisplayMaterial;
      if(material is Color)
      {
        inMaterial = new Rhino.Display.DisplayMaterial((Color) material);
      }
      if(material != null && inMaterial == null && !materialByName)
      {
        if(!(material is string))
        {
          try //We also resort to try with IConvertible
          {
            inMaterial = (Rhino.Display.DisplayMaterial) Convert.ChangeType(material, typeof(Rhino.Display.DisplayMaterial));
          }
          catch(InvalidCastException)
          {
          }
        }
      }
      if(inMaterial != null || materialByName)
      {
        string matName;

        if(!materialByName)
        {
          matName = string.Format("A:{0}-D:{1}-E:{2}-S:{3},{4}-T:{5}",
            Format(inMaterial.Ambient),
            Format(inMaterial.Diffuse),
            Format(inMaterial.Emission),
            Format(inMaterial.Specular),
            inMaterial.Shine.ToString(),
            inMaterial.Transparency.ToString()
            );
        }
        else
        {
          matName = (string) material;
        }

        int materialIndex = doc.Materials.Find(matName, true);
        if(materialIndex < 0 && !materialByName) //Material does not exist and we have its specs
        {
          materialIndex = doc.Materials.Add(); //Let's add it
          if(materialIndex > -1)
          {
            Print("Added new material at position " + materialIndex + " named \"" + matName + "\". ");
            Rhino.DocObjects.Material m = doc.Materials[materialIndex];
            m.Name = matName;
            m.AmbientColor = inMaterial.Ambient;
            m.DiffuseColor = inMaterial.Diffuse;
            m.EmissionColor = inMaterial.Emission;
            //m.ReflectionColor = no equivalent
            m.SpecularColor = inMaterial.Specular;
            m.Shine = inMaterial.Shine;
            m.Transparency = inMaterial.Transparency;
            //m.TransparentColor = no equivalent
            m.CommitChanges();

            att.MaterialSource = Rhino.DocObjects.ObjectMaterialSource.MaterialFromObject;
            att.MaterialIndex = materialIndex;
          }
          else
            Print("Material did not add. Try cleaning up your materials."); //This never happened to me.
        }
        else if(materialIndex < 0 && materialByName) //Material does not exist and we do not have its specs. We do nothing
        {
          Print("Warning: material name not found. I cannot set the source to this material name. Add a material with name: " + matName);
        }
        else
        {
          //If this material exists, we do not replace it!
          att.MaterialSource = Rhino.DocObjects.ObjectMaterialSource.MaterialFromObject;
          att.MaterialIndex = materialIndex;
        }
      }


      //Set wire density
      if(wires == -1 || wires > 0)
      {
        att.WireDensity = wires;
      }


      //Bake to the right type of object
      switch(obj.ObjectType)
      {
        case Rhino.DocObjects.ObjectType.Brep:
          doc.Objects.AddBrep(obj as Brep, att);
          break;
        case Rhino.DocObjects.ObjectType.Curve:
          doc.Objects.AddCurve(obj as Curve, att);
          break;
        case Rhino.DocObjects.ObjectType.Point:
          doc.Objects.AddPoint((obj as Rhino.Geometry.Point).Location, att);
          break;
        case Rhino.DocObjects.ObjectType.Surface:
          doc.Objects.AddSurface(obj as Surface, att);
          break;
        case Rhino.DocObjects.ObjectType.Mesh:
          doc.Objects.AddMesh(obj as Mesh, att);
          break;
        case Rhino.DocObjects.ObjectType.Extrusion:
          typeof(Rhino.DocObjects.Tables.ObjectTable).InvokeMember("AddExtrusion", BindingFlags.Instance | BindingFlags.InvokeMethod, null, doc.Objects, new object[]{obj, att});
          break;
        case Rhino.DocObjects.ObjectType.PointSet:
          doc.Objects.AddPointCloud(obj as Rhino.Geometry.PointCloud, att); //This is a speculative entry
          break;
        default:
          Print("The script does not know how to handle this type of geometry: " + obj.GetType().FullName);
          break;
      }
      Print("Added " + obj.GetType().Name);

    }
    else
    {
      Print("Inactive");
    }
# ---------- bakeattributes2: C# additional code ----------
  static string Format(Color c)
  {
    return (new System.Text.StringBuilder("A")).Append(c.A.ToString()).Append("R").Append(c.R.ToString()).Append("G")
      .Append(c.G.ToString()).Append("B").Append(c.B.ToString()).ToString();
  }
# ---------- end bakeattributes2 ----------
item_5 = ListItem(List=rev, Index=0, Wrap=Slider(0.25, range=0..1))  # -> Item, Item1
panel_10 = Panel(int_2)
item_6 = ListItem(List=rev_2, Index=0, Wrap=True)  # -> Item, Item1

# ----
# radius in Km
number_slider_3 = Slider(5, range=0..5)

# ----
# word to look for
panel_11 = Panel("art&streetart&galleries&graffiti&painting")

# ----
# word to look for
panel_12 = Panel("art&streetart&galleries&graffiti&painting")

panel_13 = Panel(bakeattributes2)
twitter = SonicTweet(Search=panel_11, GeoLat=item_5.Item, GeoLon=item_5.Item1, GeoRadius=number_slider_2, nResults=Slider(100, range=0..100))  # -> Message, fromUser, toUser, Date, Location, hasGeo, ProfilePic, Followers, ID
twitter_2 = SonicTweet(Search=panel_12, GeoLat=item_6.Item, GeoLon=item_6.Item1, GeoRadius=number_slider_3, nResults=Slider(100, range=0..100))  # -> Message, fromUser, toUser, Date, Location, hasGeo, ProfilePic, Followers, ID
panel_14 = Panel(twitter.Message)
panel_15 = Panel(twitter_2.Message)
pdecon_3 = Deconstruct(Point=twitter.Location)  # -> XComponent, YComponent, ZComponent
pdecon_4 = Deconstruct(Point=twitter_2.Location)  # -> XComponent, YComponent, ZComponent

# ----
# slider for number of lines
number_slider_4 = Slider(0.04, range=0..0.04)

# ----
# slider for number of lines
number_slider_5 = Slider(0.04, range=0..0.04)

# ----
# point on map
pt_6 = ConstructPoint(XCoordinate=pdecon_3.YComponent, YCoordinate=pdecon_3.XComponent, ZCoordinate=0)

# ----
# point on map
pt_7 = ConstructPoint(XCoordinate=pdecon_4.YComponent, YCoordinate=pdecon_4.XComponent, ZCoordinate=0)

clean_2 = CleanTree(Tree=pt_6, CleanInvalid=True, CleanEmpty=True)
clean_3 = CleanTree(Tree=pt_7, CleanInvalid=True, CleanEmpty=True)
cir_5 = Circle(Plane=pt_6, Radius=Slider(0.0001, range=0..0.01))
cir_6 = Circle(Plane=pt_7, Radius=Slider(0.0001, range=0..0.01))
prox_2 = Proximity3D(Points=clean_2, Group=5, MaxRadius=number_slider_4)  # -> flatten(Links), Topology
prox_3 = Proximity3D(Points=clean_3, Group=5, MaxRadius=number_slider_5)  # -> flatten(Links), Topology
len_2 = Length(Curve=prox_2.Links)
len_3 = Length(Curve=prox_3.Links)
dom_4 = ConstructDomain(DomainStart=Slider(0, range=0..100), DomainEnd=Slider(0, range=0..10))
bnd_4 = Bounds(Numbers=len_2)
dom_5 = ConstructDomain(DomainStart=Slider(1, range=0..100), DomainEnd=Slider(5, range=0..10))
bnd_5 = Bounds(Numbers=len_3)
remap_4 = RemapNumbers(Value=len_2, Source=bnd_4, Target=dom_4)  # -> Mapped, Clipped
remap_5 = RemapNumbers(Value=len_3, Source=bnd_5, Target=dom_5)  # -> Mapped, Clipped
crv_3 = Curve(prox_2.Links)
crv_4 = Curve(prox_3.Links)

# ----
# layernames
panel_16 = Panel("4km lines_")

# ----
# layernames
panel_17 = Panel("network line_")

int_3 = Integer(remap_4.Mapped)
int_4 = Integer(remap_5.Mapped)
# to bake the lines
toggle_2 = BooleanToggle(False)
# to bake the lines
toggle_3 = BooleanToggle(False)
concat_2 = Concatenate(FragmentA=panel_16, FragmentB=int_3)
panel_18 = Panel(concat_2)
concat_3 = Concatenate(FragmentA=panel_17, FragmentB=int_4)
panel_19 = Panel(concat_3)
bakeattributes2_2 = BakeAttributes(obj=crv_3, layer=concat_2, activate=toggle_2)  # -> out; inputs obj: GeometryBase, name: String, layer: String, color: Color, pWidth: Double, wires: Int32, activate: Boolean; same code as bakeattributes2
bakeattributes2_3 = BakeAttributes(obj=crv_4, layer=concat_3, activate=toggle_3)  # -> out; inputs obj: GeometryBase, name: String, layer: String, color: Color, pWidth: Double, wires: Int32, activate: Boolean; same code as bakeattributes2
panel_20 = Panel(bakeattributes2_2)
panel_21 = Panel(bakeattributes2_3)
