# Grasshopper definition working twitter network 2.gh (Grasshopper 0.9.75)
# plug-ins: SonicTweet

pt = Point([<point referenced from the Rhino model> x23])
cir = Circle(Plane=pt, Radius=Slider(0.0005, range=0..0.001))
pdecon = Deconstruct(Point=pt)  # -> XComponent, YComponent, ZComponent
pt_2 = ConstructPoint(XCoordinate=pdecon.XComponent, YCoordinate=pdecon.YComponent, ZCoordinate=0)

split = TextSplit(Text=pt_2, Separators="{}")
# this deletes the brackets
item = ListItem(List=split, Index=0, Wrap=True)  # -> Item, Item1, Item2, Item3

# ----
# Arts
crv = Curve([<curve referenced from the Rhino model> x34])
darc = DeconstructArc(Arc=crv)  # -> BasePlane, Radius, Angle
bnd = Bounds(Numbers=darc.Radius)
dom = ConstructDomain(DomainStart=Slider(0.0008, range=0..0.01), DomainEnd=Slider(0.0025, range=0..0.01))
pt_3 = Point(darc.BasePlane)
remap = RemapNumbers(Value=darc.Radius, Source=bnd, Target=dom)  # -> Mapped, Clipped
cir_2 = Circle(Plane=pt_3, Radius=remap.Mapped)

split_2 = TextSplit(Text=pt_3, Separators="{}")
# this deletes the brackets
item_2 = ListItem(List=split_2, Index=0, Wrap=True)  # -> Item, Item1, Item2, Item3

panel = Panel(pt_2)
panel_2 = Panel(pt_3)
item_3 = ListItem(List=item.Item1, Index=0, Wrap=Slider(12, range=0..22))
item_4 = ListItem(List=item_2.Item1, Index=0, Wrap=Slider(10, range=0..33))
cir_3 = Circle(Plane=pt_3, Radius=Slider(0.0005, range=0..0.001))
split_3 = TextSplit(Text=item_3, Separators=",")
panel_3 = Panel(split_3)
cull_i = CullIndex(List=panel_3, Indices="2", Wrap=True)
split_4 = TextSplit(Text=item_4, Separators=",")
panel_4 = Panel(split_4)
cull_i_2 = CullIndex(List=panel_4, Indices="2", Wrap=True)
rev = ReverseList(List=cull_i)
bnd_2 = Bounds(Numbers=remap.Mapped)
panel_5 = Panel(remap.Mapped)
rev_2 = ReverseList(List=cull_i_2)
dom_2 = ConstructDomain(DomainStart=Slider(1, range=0..4), DomainEnd=Slider(4, range=0..4))
remap_2 = RemapNumbers(Value=remap.Mapped, Source=bnd_2, Target=dom_2)  # -> Mapped, Clipped
# estract specific tweet:
# here you can check the message of the tweet
# you are extracting and you can use the
#  location to plot into a map
panel_6 = Panel(cull_i_2)
panel_7 = Panel(remap_2.Mapped)
item_5 = ListItem(List=rev, Index=0, Wrap=True)  # -> Item, Item1

# ----
# radius in Km
number_slider = Slider(2, range=0..5)

# ----
# word to look for
panel_8 = Panel("art&streetart&galleries&graffiti&painting")

int = Integer(panel_7)

# ----
# radius in Km
number_slider_2 = Slider(2, range=0..5)

item_6 = ListItem(List=rev_2, Index=0, Wrap=Slider(20, range=0..33))  # -> Item, Item1
panel_9 = Panel(int)

# ----
# word to look for
panel_10 = Panel("art&streetart&galleries&graffiti&painting")

twitter = SonicTweet(Search=panel_8, GeoLat=item_5.Item, GeoLon=item_5.Item1, GeoRadius=number_slider, nResults=Slider(100, range=0..100))  # -> Message, fromUser, toUser, Date, Location, hasGeo, ProfilePic, Followers, ID
twitter_2 = SonicTweet(Search=panel_10, GeoLat=item_6.Item, GeoLon=item_6.Item1, GeoRadius=number_slider_2, nResults=Slider(100, range=0..100))  # -> Message, fromUser, toUser, Date, Location, hasGeo, ProfilePic, Followers, ID
panel_11 = Panel(twitter.Message)
pdecon_2 = Deconstruct(Point=twitter.Location)  # -> XComponent, YComponent, ZComponent
panel_12 = Panel(twitter_2.Message)
pdecon_3 = Deconstruct(Point=twitter_2.Location)  # -> XComponent, YComponent, ZComponent

# ----
# slider for number of lines
number_slider_3 = Slider(0.04, range=0..0.04)

# ----
# point on map
pt_4 = ConstructPoint(XCoordinate=pdecon_2.YComponent, YCoordinate=pdecon_2.XComponent, ZCoordinate=0)

# ----
# point on map
pt_5 = ConstructPoint(XCoordinate=pdecon_3.YComponent, YCoordinate=pdecon_3.XComponent, ZCoordinate=0)

# ----
# slider for number of lines
number_slider_4 = Slider(0.04, range=0..0.04)

cir_4 = Circle(Plane=pt_4, Radius=Slider(0.0003, range=0..0.001))
clean = CleanTree(Tree=pt_4, CleanInvalid=True, CleanEmpty=True)
clean_2 = CleanTree(Tree=pt_5, CleanInvalid=True, CleanEmpty=True)
cir_5 = Circle(Plane=pt_5, Radius=Slider(0.0003, range=0..0.001))
prox = Proximity3D(Points=clean, Group=5, MaxRadius=number_slider_3)  # -> flatten(Links), Topology
len = Length(Curve=prox.Links)
prox_2 = Proximity3D(Points=clean_2, Group=5, MaxRadius=number_slider_4)  # -> flatten(Links), Topology
len_2 = Length(Curve=prox_2.Links)
dom_3 = ConstructDomain(DomainStart=Slider(0, range=0..100), DomainEnd=Slider(7, range=0..10))
bnd_3 = Bounds(Numbers=len)
dom_4 = ConstructDomain(DomainStart=Slider(0, range=0..100), DomainEnd=Slider(7, range=0..10))
bnd_4 = Bounds(Numbers=len_2)
remap_3 = RemapNumbers(Value=len, Source=bnd_3, Target=dom_3)  # -> Mapped, Clipped
crv_2 = Curve(prox.Links)
remap_4 = RemapNumbers(Value=len_2, Source=bnd_4, Target=dom_4)  # -> Mapped, Clipped

# ----
# layernames
panel_13 = Panel("network line_")

int_2 = Integer(remap_3.Mapped)
crv_3 = Curve(prox_2.Links)
# to bake the lines
toggle = BooleanToggle(False)

# ----
# layernames
panel_14 = Panel("network line_")

int_3 = Integer(remap_4.Mapped)
# to bake the lines
toggle_2 = BooleanToggle(False)
concat = Concatenate(FragmentA=panel_13, FragmentB=int_2)
panel_15 = Panel(concat)
concat_2 = Concatenate(FragmentA=panel_14, FragmentB=int_3)
panel_16 = Panel(concat_2)
bakeattributes2 = BakeAttributes(obj=crv_2, layer=concat, activate=toggle)  # -> out; inputs obj: GeometryBase, name: String, layer: String, color: Color, pWidth: Double, wires: Int32, activate: Boolean
# ---------- bakeattributes2: C# ----------
    //Inserts geometry into the Rhino document, with custom attributes
    //Written by Giulio Piacentino
    //Version written 2010 11 21 - for Grasshopper 0.8.002

    if (activate)
    {
      if(obj == null)
      {
        Print("No object to bake");
        return;
      }

      //Make new attribute to set name
      Rhino.DocObjects.ObjectAttributes att = new Rhino.DocObjects.ObjectAttributes();

      //Set object name
      if(!string.IsNullOrEmpty(name))
      {
        att.Name = name;
      }

      //Set color
      if(!color.IsEmpty)
      {
        att.ColorSource = Rhino.DocObjects.ObjectColorSource.ColorFromObject; //Make the color type "by object"
        att.ObjectColor = color;

        att.PlotColorSource = Rhino.DocObjects.ObjectPlotColorSource.PlotColorFromObject; //Make the plot color type "by object"
        att.PlotColor = color;
      }

      //Set layer
      if(!string.IsNullOrEmpty(layer) && Rhino.DocObjects.Layer.IsValidName(layer))
      {
        //Get the current layer index
        Rhino.DocObjects.Tables.LayerTable layerTable = doc.Layers;
        //int layerIndex = layerTable.Find(layer, true);
        int layerIndex = layerTable.FindByFullPath(layer, true);

        if(layerIndex < 0) //This layer does not exist, we add it
        {
          Rhino.DocObjects.Layer onlayer = new Rhino.DocObjects.Layer(); //Make a new layer
          onlayer.Name = layer;

          layerIndex = layerTable.Add(onlayer); //Add the layer to the layer table
          if (layerIndex > -1) //We manged to add layer!
          {
            att.LayerIndex = layerIndex;
            Print("Added new layer to the document at position " + layerIndex + " named " + layer + ". ");
          } else
            Print("Layer did not add. Try cleaning up your layers."); //This never happened to me.
        }
        else
          att.LayerIndex = layerIndex; //We simply add to the existing layer
      }


      //Set plotweight
      if(pWidth > 0)
      {
        att.PlotWeightSource = Rhino.DocObjects.ObjectPlotWeightSource.PlotWeightFromObject;
        att.PlotWeight = pWidth;
      }


      //Set material
      bool materialByName = !string.IsNullOrEmpty(material as string);
      Rhino.Display.DisplayMaterial inMaterial = material as Rhino.Display.DisplayMaterial;
      if(material is Color)
      {
        inMaterial = new Rhino.Display.DisplayMaterial((Color) material);
      }
      if(material != null && inMaterial == null && !materialByName)
      {
        if(!(material is string))
        {
          try //We also resort to try with IConvertible
          {
            inMaterial = (Rhino.Display.DisplayMaterial) Convert.ChangeType(material, typeof(Rhino.Display.DisplayMaterial));
          }
          catch(InvalidCastException)
          {
          }
        }
      }
      if(inMaterial != null || materialByName)
      {
        string matName;

        if(!materialByName)
        {
          matName = string.Format("A:{0}-D:{1}-E:{2}-S:{3},{4}-T:{5}",
            Format(inMaterial.Ambient),
            Format(inMaterial.Diffuse),
            Format(inMaterial.Emission),
            Format(inMaterial.Specular),
            inMaterial.Shine.ToString(),
            inMaterial.Transparency.ToString()
            );
        }
        else
        {
          matName = (string) material;
        }

        int materialIndex = doc.Materials.Find(matName, true);
        if(materialIndex < 0 && !materialByName) //Material does not exist and we have its specs
        {
          materialIndex = doc.Materials.Add(); //Let's add it
          if(materialIndex > -1)
          {
            Print("Added new material at position " + materialIndex + " named \"" + matName + "\". ");
            Rhino.DocObjects.Material m = doc.Materials[materialIndex];
            m.Name = matName;
            m.AmbientColor = inMaterial.Ambient;
            m.DiffuseColor = inMaterial.Diffuse;
            m.EmissionColor = inMaterial.Emission;
            //m.ReflectionColor = no equivalent
            m.SpecularColor = inMaterial.Specular;
            m.Shine = inMaterial.Shine;
            m.Transparency = inMaterial.Transparency;
            //m.TransparentColor = no equivalent
            m.CommitChanges();

            att.MaterialSource = Rhino.DocObjects.ObjectMaterialSource.MaterialFromObject;
            att.MaterialIndex = materialIndex;
          }
          else
            Print("Material did not add. Try cleaning up your materials."); //This never happened to me.
        }
        else if(materialIndex < 0 && materialByName) //Material does not exist and we do not have its specs. We do nothing
        {
          Print("Warning: material name not found. I cannot set the source to this material name. Add a material with name: " + matName);
        }
        else
        {
          //If this material exists, we do not replace it!
          att.MaterialSource = Rhino.DocObjects.ObjectMaterialSource.MaterialFromObject;
          att.MaterialIndex = materialIndex;
        }
      }


      //Set wire density
      if(wires == -1 || wires > 0)
      {
        att.WireDensity = wires;
      }


      //Bake to the right type of object
      switch(obj.ObjectType)
      {
        case Rhino.DocObjects.ObjectType.Brep:
          doc.Objects.AddBrep(obj as Brep, att);
          break;
        case Rhino.DocObjects.ObjectType.Curve:
          doc.Objects.AddCurve(obj as Curve, att);
          break;
        case Rhino.DocObjects.ObjectType.Point:
          doc.Objects.AddPoint((obj as Rhino.Geometry.Point).Location, att);
          break;
        case Rhino.DocObjects.ObjectType.Surface:
          doc.Objects.AddSurface(obj as Surface, att);
          break;
        case Rhino.DocObjects.ObjectType.Mesh:
          doc.Objects.AddMesh(obj as Mesh, att);
          break;
        case Rhino.DocObjects.ObjectType.Extrusion:
          typeof(Rhino.DocObjects.Tables.ObjectTable).InvokeMember("AddExtrusion", BindingFlags.Instance | BindingFlags.InvokeMethod, null, doc.Objects, new object[]{obj, att});
          break;
        case Rhino.DocObjects.ObjectType.PointSet:
          doc.Objects.AddPointCloud(obj as Rhino.Geometry.PointCloud, att); //This is a speculative entry
          break;
        default:
          Print("The script does not know how to handle this type of geometry: " + obj.GetType().FullName);
          break;
      }
      Print("Added " + obj.GetType().Name);

    }
    else
    {
      Print("Inactive");
    }
# ---------- bakeattributes2: C# additional code ----------
  static string Format(Color c)
  {
    return (new System.Text.StringBuilder("A")).Append(c.A.ToString()).Append("R").Append(c.R.ToString()).Append("G")
      .Append(c.G.ToString()).Append("B").Append(c.B.ToString()).ToString();
  }
# ---------- end bakeattributes2 ----------
bakeattributes2_2 = BakeAttributes(obj=crv_3, layer=concat_2, activate=toggle_2)  # -> out; inputs obj: GeometryBase, name: String, layer: String, color: Color, pWidth: Double, wires: Int32, activate: Boolean; same code as bakeattributes2
panel_17 = Panel(bakeattributes2)
panel_18 = Panel(bakeattributes2_2)
